# Grasshopper definition 2222terreno.gh (Grasshopper 1.0.8)
# plug-ins: RhinoCodePluginGH, NGon, Weaverbird, Section To XY
# Spherical spikey thing

panel = Panel("""arena
arena limosa
limo
limo arcilloso
arcilla arenosa
arcilla
suelo orgánico""")
panel_2 = Panel("""arena gruesa
arena fina
arena limosa
limo
limo arcilloso
arcilla arenosa
arcilla
suelo orgánico""")
panel_3 = Panel("""Bosque
Pastizales
Área urbana
Área pavimentada""")
panel_4 = Panel("""Suelo arenoso
Suelo arcilloso
N/A""")
panel_5 = Panel("""Seco
Moderado
Húmedo""")
panel_6 = Panel("""[
  { "lat": -36.6066, "lng": -72.1034 },
  { "lat": -36.6067, "lng": -72.1038 },
  { "lat": -36.6068, "lng": -72.1036 }
]""")
item = ListItem(List=panel, Index=Slider(2, range=0..6), Wrap=True)  # -> flatten(Item)
item_2 = ListItem(List=panel_2, Index=Slider(5, range=0..7), Wrap=True)  # -> flatten(Item)
húmedad_del_suelo = ListItem(List=panel_5, Index=Slider(1, range=0..2), Wrap=True)
tipo_de_suelo = ListItem(List=panel_4, Index=Slider(1, range=0..2), Wrap=True)
uso_del_suelo = ListItem(List=panel_3, Index=Slider(0, range=0..3), Wrap=True)
panel_7 = Panel("""[
  { "lat": -36.6045, "lng": -72.1038 },
  { "lat": -36.6067, "lng": -72.1078 },
  { "lat": -36.6098, "lng": -72.1009 }
]""")
panel_8 = Panel("""{
  "lat": -36.6066,
  "lng": -72.1034
}""")
txt = Text(item)
# projectId
# projectName
# projectDescription
# userId
# coordinates
# coordinatesCenter
# thumbnail
# lines
# mesh
# hillsides
# climatic
# soils
# matrix
panel_9 = Panel("\"cad9618d16cbc4b643a97c683bdc6b68\"")
txt_2 = Text(item_2)
txt_3 = Text(húmedad_del_suelo)
txt_4 = Text(uso_del_suelo)
txt_5 = Text(tipo_de_suelo)
number_slider = Slider(1, range=0..1)
almacenamiento = GetString(txt, AtLeast=1, AtMost=1, TreeAccess=False)
uso = GetString(txt_4, AtLeast=1, AtMost=1, TreeAccess=False)
infiltracion = GetString(txt_2, AtLeast=1, AtMost=1, TreeAccess=False)
tipo = GetString(txt_5, AtLeast=1, AtMost=1, TreeAccess=False)
humedad = GetString(txt_3, AtLeast=1, AtMost=1, TreeAccess=False)
branch_length = Slider(10, range=0..10)
cell_radius = Slider(3.79, range=0..10)
coordinatescenter = GetString(panel_8, AtLeast=1, AtMost=1, TreeAccess=False)
coordinates = GetString(panel_7, AtLeast=1, AtMost=1, TreeAccess=False)
projectdescription = GetString(number_slider, AtLeast=1, AtMost=1, TreeAccess=False)
projectname = GetString(number_slider, AtLeast=1, AtMost=1, TreeAccess=False)
projectid = GetString(number_slider, AtLeast=1, AtMost=1, TreeAccess=False)
userid = GetString(number_slider, AtLeast=1, AtMost=1, TreeAccess=False)
panel_10 = Panel(uso)
count = GetNumber(
    Slider(8, range=1..100),
    AtLeast=1,
    AtMost=2147483647,
    Maximum=1.797693135e+308,
    Minimum=-1.797693135e+308,
    TreeAccess=False)
radius = GetNumber(cell_radius, AtLeast=1, AtMost=2147483647, Maximum=1.797693135e+308, Minimum=-1.797693135e+308, TreeAccess=False)
length = GetNumber(branch_length, AtLeast=1, AtMost=2147483647, Maximum=1.797693135e+308, Minimum=-1.797693135e+308, TreeAccess=False)
py3 = Python3Script(x=coordinates)  # -> out, a, b; inputs x: String
# ---------- py3: Python ----------
import json

# Inicializa listas para almacenar latitudes y longitudes
latitudes = []
longitudes = []

try:
    # Cargar la lista de coordenadas desde la entrada `x`
    data = json.loads(x)
    
    # Iterar sobre cada elemento en la lista de coordenadas
    for item in data:
        latitudes.append(item["lat"])
        longitudes.append(item["lng"])

    # Asignar las listas de latitudes y longitudes a las salidas
    a = latitudes
    b = longitudes

except json.JSONDecodeError:
    # En caso de error en el formato JSON, se asignan mensajes de error
    a = "Error en el formato JSON"
    b = "Error en el formato JSON"
# ---------- end py3 ----------
py3_2 = Python3Script(x=coordinatescenter)  # -> out, a, b; inputs x: String
# ---------- py3_2: Python ----------
import json

try:
    # Asegúrate de que x sea tratado como un string de JSON con comillas dobles
    x = x.replace("'", "\"")  # Reemplaza comillas simples con dobles si es necesario
    data = json.loads(x)
    
    # Extraer latitud y longitud
    a = data["lat"]
    b = data["lng"]

except json.JSONDecodeError:
    # En caso de que el JSON esté mal formateado
    a = "Error"
    b = "Error"
# ---------- end py3_2 ----------

utm_to_geo = Python3Script()  # -> out, a, b; inputs e: Double, n: Double
# ---------- utm_to_geo: Python ----------
from pyproj import CRS, Transformer

def utm_to_latlon(x, y, zone_number, is_northern):
    # Determinar el código EPSG basado en la zona y el hemisferio
    if is_northern:
        epsg_code = 32600 + zone_number  # UTM Norte
    else:
        epsg_code = 32700 + zone_number  # UTM Sur

    # Definir los sistemas de coordenadas
    utm_crs = CRS.from_epsg(epsg_code)
    wgs84_crs = CRS.from_epsg(4326)  # WGS84 Lat/Lon

    # Crear el transformador con always_xy=True para asegurar el orden lon, lat
    transformer = Transformer.from_crs(utm_crs, wgs84_crs, always_xy=True)

    # Transformar las coordenadas
    lon, lat = transformer.transform(x, y)

    return lat, lon

# Ejemplo de uso con tus datos específicos
x = e      # Coordenada UTM Este
y = n     # Coordenada UTM Norte
zone_number = 18
is_northern = False  # Hemisferio Sur

# Convertir coordenadas
latitude, longitude = utm_to_latlon(x, y, zone_number, is_northern)

# Asignar la salida a las variables de Grasshopper o tu aplicación
a = latitude
b = longitude

# Imprimir información adicional
print(f"Latitud: {latitude}, Longitud: {longitude}")
# ---------- end utm_to_geo ----------
geo_to_utm = Python3Script(x=py3.a, y=py3.b)  # -> out, a, b; inputs x: Double, y: Double
# ---------- geo_to_utm: Python ----------
from pyproj import CRS, Transformer

def latlon_to_utm(lat, lon):
    # Determinar la zona UTM en función de la longitud
    zone_number = int((lon + 180) / 6) + 1
    
    # Limitar el número de zona para evitar valores fuera del rango permitido
    zone_number = max(1, min(60, zone_number))

    # Determinar el hemisferio en función de la latitud
    is_northern = lat >= 0

    # Determinar el código EPSG basado en la zona y el hemisferio
    if is_northern:
        epsg_code = 32600 + zone_number  # UTM Norte
    else:
        epsg_code = 32700 + zone_number  # UTM Sur

    # Validar el sistema de coordenadas UTM basado en el EPSG
    try:
        utm_crs = CRS.from_epsg(epsg_code)
    except Exception as e:
        print(f"Error: código EPSG {epsg_code} no válido. Detalle del error: {e}")
        return None, None

    # Definir los sistemas de coordenadas
    wgs84_crs = CRS.from_epsg(4326)  # WGS84 Lat/Lon

    # Crear el transformador con always_xy=True para asegurar el orden lon, lat
    transformer = Transformer.from_crs(wgs84_crs, utm_crs, always_xy=True)

    # Transformar las coordenadas
    utm_x, utm_y = transformer.transform(lon, lat)

    return utm_x, utm_y

# Convertir coordenadas usando las entradas de Grasshopper
utm_x, utm_y = latlon_to_utm(x, y)

# Asignar la salida a las variables de Grasshopper
a = utm_x
b = utm_y
# ---------- end geo_to_utm ----------

pt = ConstructPoint(XCoordinate=0, YCoordinate=0, ZCoordinate=0)
pt_2 = ConstructPoint(XCoordinate=geo_to_utm.a, YCoordinate=geo_to_utm.b, ZCoordinate=0)
py3_3 = Python3Script(x=py3_2.a, y=py3_2.b)  # -> out, a; inputs x: Double, y: Double
# ---------- py3_3: Python ----------
import sys

sys.path.append(r'C:/archivos_rhino/')

import math
import os
import tempfile
import urllib.request
from pyproj import CRS, Transformer
import Rhino.Geometry as rg  # Importamos Rhino.Geometry para utilizar Point3d

def calculate_bounds(latitude, longitude, radius):
    R = 6378137  # Radio de la Tierra en metros
    radius_in_degrees = radius / R * (180 / math.pi)
    
    min_lat = latitude - radius_in_degrees
    max_lat = latitude + radius_in_degrees
    min_lon = longitude - radius_in_degrees / math.cos(latitude * math.pi / 180)
    max_lon = longitude + radius_in_degrees / math.cos(latitude * math.pi / 180)
    
    return min_lat, max_lat, min_lon, max_lon

def fetch_opentopography_points(latitude, longitude, radius, api_key):
    min_lat, max_lat, min_lon, max_lon = calculate_bounds(latitude, longitude, radius)
    
    url = (
        f"https://portal.opentopography.org/API/globaldem?demtype=NASADEM"
        f"&south={min_lat}&north={max_lat}&west={min_lon}&east={max_lon}"
        f"&outputFormat=AAIGrid&API_Key={api_key}"
    )
    
    try:
        with urllib.request.urlopen(url) as response:
            if response.status == 200:
                temp_dir = tempfile.gettempdir()
                file_path = os.path.join(temp_dir, "terrain_data.asc")
                with open(file_path, "wb") as file:
                    file.write(response.read())
                return file_path
            else:
                raise Exception(f"Error al obtener los datos: {response.status}, {response.reason}")
    except Exception as e:
        raise Exception(f"Error al realizar la solicitud HTTP: {str(e)}")

def extract_points_from_aaigrid(file_path, zone_number, is_northern):
    with open(file_path, 'r') as f:
        header = {}
        data_start = 0
        for i, line in enumerate(f):
            line = line.strip()
            if line.startswith('ncols'):
                header['ncols'] = int(line.split()[1])
            elif line.startswith('nrows'):
                header['nrows'] = int(line.split()[1])
            elif line.startswith('xllcorner') or line.startswith('xllcenter'):
                header['xllcorner'] = float(line.split()[1])
            elif line.startswith('yllcorner') or line.startswith('yllcenter'):
                header['yllcorner'] = float(line.split()[1])
            elif line.startswith('cellsize'):
                header['cellsize'] = float(line.split()[1])
            elif line.startswith('NODATA_value'):
                header['NODATA_value'] = float(line.split()[1])
            else:
                data_start = i
                break  # Fin del encabezado
        else:
            raise Exception('Formato de archivo AAIGrid inválido: encabezado incompleto')

    # Leer los datos de la cuadrícula
    data = []
    with open(file_path, 'r') as f:
        # Saltar las líneas de encabezado
        for _ in range(data_start):
            next(f)
        for line in f:
            row = [float(val) for val in line.strip().split()]
            data.append(row)

    nrows = header['nrows']
    ncols = header['ncols']
    xllcorner = header['xllcorner']
    yllcorner = header['yllcorner']
    cellsize = header['cellsize']
    nodata = header.get('NODATA_value', None)

    points = []
    # Definir la transformación de coordenadas
    crs_utm = CRS(proj='utm', zone=zone_number, south=not is_northern)
    transformer = Transformer.from_crs("epsg:4326", crs_utm, always_xy=True)

    # Generar los puntos
    for row_index in range(nrows):
        y = yllcorner + (nrows - 1 - row_index) * cellsize  # De arriba hacia abajo
        grid_row = data[row_index]
        for col_index in range(ncols):
            x = xllcorner + col_index * cellsize
            z = grid_row[col_index]
            if nodata is not None and z == nodata:
                continue  # Omitir valores NODATA
            # Transformar coordenadas a UTM
            x_utm, y_utm = transformer.transform(x, y)
            # Crear un objeto Point3d
            point = rg.Point3d(x_utm, y_utm, z)
            points.append(point)
    return points

def get_utm_zone(longitude):
    return int((longitude + 180) / 6) + 1

# Entradas
latitude = x  # Latitud de entrada
longitude = y  # Longitud de entrada
radius = 600  # Radio de búsqueda en metros
api_key = "cad9618d16cbc4b643a97c683bdc6b68"  # Reemplaza con tu clave de API

# Obtener datos
try:
    file_path = fetch_opentopography_points(latitude, longitude, radius, api_key)
    zone_number = get_utm_zone(longitude)
    is_northern = latitude >= 0
    points = extract_points_from_aaigrid(file_path, zone_number, is_northern)
    a = points  # Salida para Grasshopper como objetos Point3d
except Exception as e:
    print(str(e))
    a = []  # Salida vacía en caso de error
# ---------- end py3_3 ----------
msphere = MeshSphere(Base=pt, Radius=radius, UCount=10, VCount=20)
path = FilePath("C:\archivos_rhino\Precipitaciones.xlsx")
pline = PolyLine(Vertices=pt_2, Closed=True)
pt_3 = Point(py3_3.a)
crv = Curve(pline)
panel_11 = Panel(path)
popgeo = PopulateGeometry(Geometry=msphere, Count=count, Seed=1)
del = DelaunayMesh(Points=pt_3, Plane=PlaneXY(0, 0, 0))
facet = FacetDome(Points=popgeo, Radius=radius)  # -> Pattern, Dome
path_2 = FilePath(panel_11)
wbcatmullclark = WeaverbirdsCatmullClarkSubdivision(MeshCurves=del, Level=1, SmoothNakedEdges=1)
slope = Slope(Mesh=del)  # -> Mesh, Colors, Tags, Slope
explode = Explode(Curve=facet.Pattern, Recursive=True)  # -> Segments, Vertices
py3_4 = Python3Script(Mesh=wbcatmullclark)  # -> out, concavity_values_interpolated; inputs Mesh: Mesh; disabled
# ---------- py3_4: Python ----------
import Rhino.Geometry as rg

# Función para calcular concavidad de manera optimizada
def calculate_concavidity(mesh):
    vertex_count = mesh.Vertices.Count
    concavity_values = [0.0] * vertex_count  # Prealocar la lista de valores de concavidad
    
    # Iterar sobre los vértices de la malla
    for i in range(vertex_count):
        vertex = mesh.Vertices[i]
        neighbors = mesh.TopologyVertices.ConnectedTopologyVertices(i)
        
        # Obtener las coordenadas del vértice
        px, py, pz = vertex.X, vertex.Y, vertex.Z
        
        # Calcular el promedio de los vecinos en un solo paso
        avg_x, avg_y, avg_z = 0.0, 0.0, 0.0
        neighbor_count = len(neighbors)
        
        for n in neighbors:
            neighbor_vertex = mesh.Vertices[n]
            avg_x += neighbor_vertex.X
            avg_y += neighbor_vertex.Y
            avg_z += neighbor_vertex.Z
        
        avg_x /= neighbor_count
        avg_y /= neighbor_count
        avg_z /= neighbor_count
        
        # Calcular la distancia entre el vértice y el promedio de los vecinos
        dist_sq = (px - avg_x) ** 2 + (py - avg_y) ** 2 + (pz - avg_z) ** 2
        dist = dist_sq ** 0.5
        
        # Concavidad relativa
        concavity = dist if avg_z < pz else -dist
        concavity_values[i] = concavity  # Asignar directamente el valor
    
    return concavity_values

# Interpolación de vecinos con acceso optimizado
def interpolate_neighbors_optimized(mesh, values, iterations=5):
    vertex_count = mesh.Vertices.Count
    neighbor_map = [mesh.TopologyVertices.ConnectedTopologyVertices(i) for i in range(vertex_count)]  # Precalcular vecinos

    for _ in range(iterations):
        new_values = values[:]  # Copiar la lista actual para mantener los valores anteriores
        
        # Iterar sobre los vértices de la malla
        for i in range(vertex_count):
            neighbors = neighbor_map[i]
            neighbor_sum = sum(values[v] for v in neighbors)
            new_values[i] = neighbor_sum / len(neighbors)
        
        values = new_values  # Actualizar los valores suavizados
    return values

# Normalizar valores a un rango entre 0 y 1
def normalize_values(values):
    min_val = min(values)
    max_val = max(values)
    if max_val == min_val:
        return [0.5] * len(values)  # Evitar división por cero si todos los valores son iguales
    normalized = [(v - min_val) / (max_val - min_val) for v in values]
    return normalized

# Entrada
mesh = Mesh

# Calcular valores de concavidad optimizados
concavity_values = calculate_concavidity(mesh)

# Aplicar varias iteraciones de interpolación de vecinos con optimización
concavity_values_interpolated = interpolate_neighbors_optimized(mesh, concavity_values, iterations=15)

# Normalizar los valores suavizados
concavity_values_normalized = normalize_values(concavity_values_interpolated)

# Salidas
a = concavity_values_normalized  # Valores suavizados y normalizados
# ---------- end py3_4 ----------
concavity = Concavity(Mesh=del)  # -> Mesh, Colors, Tags, Concavity
demesh = DeconstructMesh(Mesh=slope.Mesh)  # -> Vertices, Faces, Colours, Normals
concavity_2 = Concavity(Mesh=wbcatmullclark)  # -> Mesh, Colors, Tags, Concavity
curvepoint = PointOnCurve(explode.Segments, parameter=0.5)
crv_2 = Curve(crv)
avr = Average(Input=curvepoint)
lng = ListLength(List=explode.Segments)
py3_5 = Python3Script(mallacolorconcavidad=concavity.Mesh, cdata=concavity.Concavity, colorpendiente=demesh.Colours, pdata=slope.Slope)  # -> out, b; inputs mallacolorconcavidad: Mesh, cdata: Double, colorpendiente: String, pdata: Double; disabled
# ---------- py3_5: Python ----------
import rhinoscriptsyntax as rs
import Rhino.Geometry as rg
import json

def mesh_to_dict(mallacolorconcavidad, cdata, colorpendiente, pdata):
    # Extraer vértices de la malla
    vertex_list = [[v.X, v.Y, v.Z] for v in mallacolorconcavidad.Vertices]
    
    # Extraer colores de los vértices de la malla coloreada (concavidad)
    vertex_colours_concavidad = []
    if mallacolorconcavidad.VertexColors.Count == mallacolorconcavidad.Vertices.Count:
        vertex_colours_concavidad = [[color.R, color.G, color.B] for color in mallacolorconcavidad.VertexColors]
    else:
        # Si no hay colores, asigna blanco por defecto
        vertex_colours_concavidad = [[255, 255, 255]] * len(vertex_list)

    # Extraer las caras de la malla
    face_list = []
    for face in mallacolorconcavidad.Faces:
        if face.IsTriangle:
            face_list.append([face.A, face.B, face.C])
        elif face.IsQuad:
            face_list.append([face.A, face.B, face.C])
            face_list.append([face.A, face.C, face.D])

    # Asegurarse de que colorpendiente tiene el formato adecuado
    color_pendiente_list = [color if isinstance(color, list) and len(color) == 3 else [255, 255, 255] for color in colorpendiente]
    
    # Crear el diccionario final con las estructuras solicitadas
    return {
        "vertices": vertex_list,
        "faces": face_list,
        "colors_concavidad": vertex_colours_concavidad,
        "concavidad_data": cdata,  # Datos de concavidad por vértice
        "colors_pendiente": color_pendiente_list,  # Colores adicionales de la pendiente
        "pendiente_data": pdata  # Datos de pendiente por vértice
    }

def main(mallacolorconcavidad, cdata, colorpendiente, pdata):
    if not mallacolorconcavidad:
        print("Se requiere una malla.")
        return None
    
    data = mesh_to_dict(mallacolorconcavidad, cdata, colorpendiente, pdata)
    
    if data is None:
        print("Error al estructurar los datos de la malla.")
        return None
    
    # Convertir el diccionario a una cadena JSON
    json_string = json.dumps(data)
    return json_string

# Asignar las entradas de Grasshopper
mallacolorconcavidad = mallacolorconcavidad
cdata = cdata
colorpendiente = colorpendiente
pdata = pdata

# Ejecutar la función principal y asignar la salida
b = main(mallacolorconcavidad, cdata, colorpendiente, pdata)  # JSON como string
# ---------- end py3_5 ----------
longitud_cauce = Slider(6, range=0..10)
number_slider_2 = Slider(10, range=0..100)
mapeo_coef_escorr_python = Script(x=uso, y=tipo, z=humedad)  # -> out, a; inputs x: String, y: String, z: String
# ---------- mapeo_coef_escorr_python: Python ----------
import sys

sys.path.append(r'C:/archivos_rhino/')

"""Provides a scripting component.
    Inputs:
        x: The x script variable
        y: The y script variable
    Output:
        a: The a output variable"""

__author__ = "aniba"
__version__ = "2023.07.13"

import rhinoscriptsyntax as rs #  MAPEO
runoff_coefficients = {
    ("Bosque", "Suelo arenoso", "Seco"): (0.02, 0.10),
    ("Bosque", "Suelo arenoso", "Moderado"): (0.05, 0.25),
    ("Bosque", "Suelo arenoso", "Húmedo"): (0.25, 0.50),
    ("Bosque", "Suelo arcilloso", "Seco"): (0.10, 0.25),
    ("Bosque", "Suelo arcilloso", "Moderado"): (0.18, 0.35),
    ("Bosque", "Suelo arcilloso", "Húmedo"): (0.35, 0.60),
    ("Pastizales", "Suelo arenoso", "Seco"): (0.02, 0.15),
    ("Pastizales", "Suelo arenoso", "Moderado"): (0.05, 0.20),
    ("Pastizales", "Suelo arenoso", "Húmedo"): (0.20, 0.45),
    ("Pastizales", "Suelo arcilloso", "Seco"): (0.08, 0.20),
    ("Pastizales", "Suelo arcilloso", "Moderado"): (0.13, 0.30),
    ("Pastizales", "Suelo arcilloso", "Húmedo"): (0.30, 0.55),
    ("Área urbana", "Suelo arenoso", "Seco"): (0.05, 0.35),
    ("Área urbana", "Suelo arenoso", "Moderado"): (0.10, 0.50),
    ("Área urbana", "Suelo arenoso", "Húmedo"): (0.50, 0.75),
    ("Área urbana", "Suelo arcilloso", "Seco"): (0.20, 0.60),
    ("Área urbana", "Suelo arcilloso", "Moderado"): (0.30, 0.70),
    ("Área urbana", "Suelo arcilloso", "Húmedo"): (0.70, 0.90),
    ("Área pavimentada", "N/A", "Seco"): (0.60, 0.90),
    ("Área pavimentada", "N/A", "Moderado"): (0.70, 0.95),
    ("Área pavimentada", "N/A", "Húmedo"): (0.85, 0.98)
}

# Tomar como entrada el tipo de suelo, el uso del suelo y las condiciones de humedad del suelo
land_use = x  # 'x' por el nombre de la variable de entrada correspondiente en Grasshopper
soil_type = y  #'y' por el nombre de la variable de entrada correspondiente en Grasshopper
soil_moisture = z  #  'z' por el nombre de la variable de entrada correspondiente en Grasshopper

# Buscar en el diccionario el coeficiente de escorrentía correspondiente
runoff_coefficient = runoff_coefficients.get((land_use, soil_type, soil_moisture))

# Imprimir el coeficiente de escorrentía
print(runoff_coefficient)
# ---------- end mapeo_coef_escorr_python ----------
larger = LargerThan(FirstNumber=concavity_2.Concavity, SecondNumber=Slider(0, range=0..1))  # -> LargerThan, OrEqualTo
vec2pt = Vector2Pt(PointA=pt, PointB=avr, Unitize=invert(False))  # -> Vector, Length
rep = ReplaceText(Text=mapeo_coef_escorr_python.out, Find="(", Replace=" ", RecursiveReplace=False)
rep_2 = ReplaceText(Text=rep, Find=")", Replace=" ", RecursiveReplace=False)
amp = Amplitude(Vector=vec2pt.Vector, Amplitude=length)
mesh = Mesh(concavity_2.Mesh)
split = TextSplit(Text=rep_2, Separators=",")
calcula_pp_maxdiarias = Python3Script(x=path_2, y=number_slider_2)  # -> out, a, b, c; inputs x: String, y: Double
# ---------- calcula_pp_maxdiarias: Python ----------
import sys

sys.path.append(r'C:/archivos_rhino/')

import rhinoscriptsyntax as rs
import scriptcontext as sc
import System
import System.Collections.Generic
import Rhino
import locale
locale.setlocale(locale.LC_ALL, 'es_ES')

import numpy as np
from scipy import stats
from scipy.stats import genextreme, gumbel_r, lognorm, norm, weibull_min
import openpyxl

def is_number(s):
    """ Returns True if string is a number. """
    try:
        float(s)
        return True
    except ValueError:
        return False

def load_excel(path):
    # Cargar el workbook
    try:
        workbook = openpyxl.load_workbook(path, data_only=True)
        sheet = workbook.active  # o workbook[sheet_name] si conoces el nombre de la hoja

        data = []
        for row in sheet.iter_rows(values_only=True):
            # Aseguramos que la columna B (índice 1) sea convertida adecuadamente
            cell = row[1]  # Columna B
            if is_number(cell):
                data.append(float(cell))
            else:
                data.append(np.nan)
        
        return data
    except Exception as e:
        print(f"Error loading Excel file: {e}")
        return []

# Reemplazo 'Precipitaciones.xlsx' con la variable 'x', que debe ser definida fuera de este script
# 'y' es una lista o array de periodos de retorno, definida fuera de este script
if x and y:
    precipitaciones = np.array(load_excel(x))
    if precipitaciones.size == 0:
        a = "No se pudieron cargar datos desde el archivo Excel."
    else:
        # Filtrar out NaN values que pueden interferir con análisis estadísticos
        precipitaciones = precipitaciones[~np.isnan(precipitaciones)]

        if precipitaciones.size == 0:
            a = "No hay datos válidos para analizar después de filtrar NaNs."
        else:
            periodos_retorno = np.array(y, dtype=np.float64)  # Convertimos los periodos a float para evitar conflictos de tipo
            distribuciones = [genextreme, gumbel_r, lognorm, norm]
            results = []
            best_ks_fit = None
            best_ks_p_value = -1  # Inicializamos con un valor imposible para asegurar que cualquier p-value será mayor
            best_chi2_fit = None
            best_chi2_p_value = -1  # Inicializamos con un valor imposible para asegurar que cualquier p-value será mayor

            for distribucion in distribuciones:
                distribution_results = "Distribución: {}\n".format(distribucion.name)

                params = distribucion.fit(precipitaciones)
                precipitaciones_retorno = distribucion.ppf(1 - 1 / periodos_retorno, *params)

                # Guardar resultados
                distribution_results += "Periodos de Retorno: {}\n".format(periodos_retorno.tolist())
                distribution_results += "Precipitaciones de Retorno: {}\n".format(precipitaciones_retorno.tolist())

                ks_stat, ks_p_value = stats.kstest(precipitaciones, cdf=distribucion.name, args=params)
                distribution_results += "Kolmogorov-Smirnov Statistic: {:.5f}\n".format(ks_stat)
                distribution_results += "Kolmogorov-Smirnov p-value: {:.5f}\n".format(ks_p_value)

                observed_freq, bin_edges = np.histogram(precipitaciones, bins='auto', density=False)
                expected_freq = distribucion.pdf(bin_edges[:-1], *params) * np.diff(bin_edges) * len(precipitaciones)
                expected_freq = expected_freq.astype(np.float64)  # Asegurarse que expected_freq es float para evitar problemas de tipo
                observed_freq = observed_freq.astype(np.float64)  # Convertir observed_freq a float64 para compatibilidad
                observed_freq *= (sum(expected_freq) / sum(observed_freq))  # Normalize observed frequencies
                chi2_stat, chi2_p_value = stats.chisquare(observed_freq, expected_freq)
                distribution_results += "Chi-squared Statistic: {:.5f}\n".format(chi2_stat)
                distribution_results += "Chi-squared p-value: {:.5f}\n".format(chi2_p_value)

                results.append(distribution_results)

                # Verificar si esta distribución tiene el mayor p-value de Kolmogorov-Smirnov
                if ks_p_value > best_ks_p_value:
                    best_ks_p_value = ks_p_value
                    best_ks_fit = distribucion

                # Verificar si esta distribución tiene el mayor p-value de chi-cuadrado
                if chi2_p_value > best_chi2_p_value:
                    best_chi2_p_value = chi2_p_value
                    best_chi2_fit = distribucion

            # Almacenar los resultados en la variable 'a' para salida
            a = "\n".join(results)
            if best_ks_fit is not None and best_chi2_fit is not None:
                if best_ks_fit == best_chi2_fit:
                    selected_fit = best_ks_fit
                    b = "La distribución con los mayores p-values tanto de Kolmogorov-Smirnov como de Chi-cuadrado es: {}\n".format(selected_fit.name)
                    b += "Con un p-value de Kolmogorov-Smirnov de: {:.5f} y un p-value de Chi-cuadrado de: {:.5f}".format(best_ks_p_value, best_chi2_p_value)
                else:
                    selected_fit = best_chi2_fit
                    b = "Las distribuciones con los mayores p-values son diferentes.\n"
                    b += "Se elige la distribución con el mayor p-value de Chi-cuadrado: {}\n".format(selected_fit.name)
                    b += "Con un p-value de: {:.5f}".format(best_chi2_p_value)
                
                params = selected_fit.fit(precipitaciones)
                c = selected_fit.ppf(1 - 1 / periodos_retorno, *params).tolist()
            else:
                b = "No se encontraron distribuciones adecuadas."
                c = []
# ---------- end calcula_pp_maxdiarias ----------
comprobación = Python3Script(x=path_2, y=number_slider_2)  # -> out, a, b; inputs x: String, y: Double; disabled
# ---------- comprobación: Python ----------
import rhinoscriptsyntax as rs
import scriptcontext as sc
import System
import System.Collections.Generic
import Rhino
import locale
locale.setlocale(locale.LC_ALL, 'es_ES')

import sys

sys.path.append(r'C:/archivos_rhino/')
import numpy as np
from scipy import stats
from scipy.stats import genextreme, gumbel_r, lognorm, norm, weibull_min
import openpyxl

def is_number(s):
    """ Returns True if string is a number. """
    try:
        float(s)
        return True
    except ValueError:
        return False

def load_excel(path):
    # Cargar el workbook
    try:
        workbook = openpyxl.load_workbook(path, data_only=True)
        sheet = workbook.active  # o workbook[sheet_name] si conoces el nombre de la hoja

        data = []
        for row in sheet.iter_rows(values_only=True):
            # Aseguramos que la columna B (índice 1) sea convertida adecuadamente
            cell = row[1]  # Columna B
            if is_number(cell):
                data.append(float(cell))
            else:
                data.append(np.nan)
        
        return data
    except Exception as e:
        print(f"Error loading Excel file: {e}")
        return []

# Reemplazo 'Precipitaciones.xlsx' con la variable 'x', que debe ser definida fuera de este script
# 'y' es una lista o array de periodos de retorno, definida fuera de este script
if x and y:
    precipitaciones = np.array(load_excel(x))
    if precipitaciones.size == 0:
        a = "No se pudieron cargar datos desde el archivo Excel."
    else:
        # Filtrar out NaN values que pueden interferir con análisis estadísticos
        precipitaciones = precipitaciones[~np.isnan(precipitaciones)]

        if precipitaciones.size == 0:
            a = "No hay datos válidos para analizar después de filtrar NaNs."
        else:
            periodos_retorno = np.array(y, dtype=np.float64)  # Convertimos los periodos a float para evitar conflictos de tipo
            distribuciones = [genextreme, gumbel_r, lognorm, norm]
            results = []
            best_fit = None
            best_p_value = -1  # Inicializamos con un valor imposible para asegurar que cualquier p-value será mayor

            for distribucion in distribuciones:
                distribution_results = "Distribución: {}\n".format(distribucion.name)

                params = distribucion.fit(precipitaciones)
                precipitaciones_retorno = distribucion.ppf(1 - 1 / periodos_retorno, *params)

                # Guardar resultados
                distribution_results += "Periodos de Retorno: {}\n".format(periodos_retorno.tolist())
                distribution_results += "Precipitaciones de Retorno: {}\n".format(precipitaciones_retorno.tolist())

                ks_stat, ks_p_value = stats.kstest(precipitaciones, cdf=distribucion.name, args=params)
                distribution_results += "Kolmogorov-Smirnov Statistic: {:.5f}\n".format(ks_stat)
                distribution_results += "Kolmogorov-Smirnov p-value: {:.5f}\n".format(ks_p_value)

                observed_freq, bin_edges = np.histogram(precipitaciones, bins='auto', density=False)
                expected_freq = distribucion.pdf(bin_edges[:-1], *params) * np.diff(bin_edges) * len(precipitaciones)
                expected_freq = expected_freq.astype(np.float64)  # Asegurarse que expected_freq es float para evitar problemas de tipo
                observed_freq = observed_freq.astype(np.float64)  # Convertir observed_freq a float64 para compatibilidad
                observed_freq *= (sum(expected_freq) / sum(observed_freq))  # Normalize observed frequencies
                chi2_stat, chi2_p_value = stats.chisquare(observed_freq, expected_freq)
                distribution_results += "Chi-squared Statistic: {:.5f}\n".format(chi2_stat)
                distribution_results += "Chi-squared p-value: {:.5f}\n".format(chi2_p_value)

                results.append(distribution_results)

                # Verificar si esta distribución tiene un p-value mayor
                if ks_p_value > best_p_value:
                    best_p_value = ks_p_value
                    best_fit = distribucion

            # Almacenar los resultados en la variable 'a' para salida
            a = "\n".join(results)
            if best_fit is not None:
                b = "La distribución más adecuada es: {}\nCon un p-value de: {:.5f}".format(best_fit.name, best_p_value)
            else:
                b = "No se encontró una distribución adecuada."
# ---------- end comprobación ----------
addition = Addition(A=avr, B=amp)
py3_6 = Python3Script(x=split)  # -> out, a; inputs x: Double
# ---------- py3_6: Python ----------
a = x
# ---------- end py3_6 ----------
avr_2 = Average(Input=py3_6.a)
end = EndPoints(Curve=graft(explode.Segments))  # -> Start, End
coeficiente_de_escorrentia = Panel(avr_2)
dup = DuplicateData(Data=addition, Number=lng, Order=True)
precipitaciones_acumuladas_diarias_para = Panel(calcula_pp_maxdiarias.c)  # "Precipitaciones acumuladas diarias para 10años"
panel_12 = Panel(calcula_pp_maxdiarias.b)
pshift = ShiftPaths(Data=dup, Offset=-1)  # -> graft(Data)
cullv = CullVertices(Mesh=wbcatmullclark, Pattern=larger.LargerThan, Shrink=True)
panel_13 = Panel(comprobación.b)
merge = Merge(Data1=end.Start, Data2=end.End, Data3=pshift)
triangle = MeshTriangle(CornerA=0, CornerB=1, CornerC=2)
project = Project(Geometry=cullv, Plane=PlaneXY(0, 0, 0))  # -> Geometry, Transform
conmesh = ConstructMesh(Vertices=merge, Faces=triangle)
disjoint = DisjointMesh(Mesh=project.Geometry)
area = Area(Geometry=disjoint)  # -> Area, Centroid
panel_14 = Panel(calcula_pp_maxdiarias.a)
mjoin = MeshJoin(Meshes=flatten(conmesh))
cullv_2 = CullVertices(Mesh=wbcatmullclark, Pattern=invert(larger.LargerThan), Shrink=True)
rugosidad_de_manning = Slider(0.025, range=0..0.1)
larger_2 = LargerThan(FirstNumber=area.Area, SecondNumber=Slider(3000, range=0..10000))  # -> LargerThan, OrEqualTo
pendiente_canal = Slider(0.001, range=0..0.01)
ancho_canal = Slider(1, range=0..1)
alignvert = AlignVertices(Mesh=mjoin, Tolerance=0.1)  # -> Result, Count
cull = CullPattern(List=disjoint, CullPattern=larger_2.LargerThan)
number_slider_3 = Slider(100, range=0..100)
mjoin_2 = MeshJoin(Meshes=cull)
project_2 = Project(Geometry=cullv_2, Plane=PlaneXY(0, 0, 0))  # -> Geometry, Transform
weld = WeldMesh(Mesh=alignvert.Result, Angle=3.141592654)
disjoint_2 = DisjointMesh(Mesh=project_2.Geometry)
subdmesh = SubDFromMesh(Mesh=weld, Creases=1, Corners=1, Interpolate=False)
area_2 = Area(Geometry=disjoint_2)  # -> Area, Centroid
mesh_2 = Mesh(mjoin_2)
larger_3 = LargerThan(FirstNumber=area_2.Area, SecondNumber=Slider(2500, range=0..10000))  # -> LargerThan, OrEqualTo
meshsubd = MeshFromSubD(SubD=subdmesh, Density=2)
cull_2 = CullPattern(List=disjoint_2, CullPattern=larger_3.LargerThan)
wbnaked = WeaverbirdsNakedBoundary(MeshClosedPolylines=mesh_2)
py3_7 = Python3Script(mesh=mjoin_2)  # -> out, a; inputs mesh: Mesh
# ---------- py3_7: Python ----------
import Rhino
import Grasshopper as gh

def naked_boundary_indices(mesh):
    # Obtener las aristas desnudas de la malla (naked edges)
    naked_edges = mesh.GetNakedEdgePointStatus()
    
    # Crear una lista para almacenar los índices de los vértices desnudos
    naked_boundary_indices = []
    
    # Iterar sobre los vértices de la malla
    for i in range(mesh.Vertices.Count):
        # Si el vértice es parte de una arista desnuda, agregar el índice a la lista
        if naked_edges[i]:
            naked_boundary_indices.append(i)
    
    return naked_boundary_indices

# Comprobar si la malla es válida
if isinstance(mesh, Rhino.Geometry.Mesh):
    a = naked_boundary_indices(mesh)
else:
    a = gh.DataTree[object]()
    a.Add("Entrada no válida")
# ---------- end py3_7 ----------
wbframe = WeaverbirdsPictureFrame(MeshPolylines=meshsubd, Distance=5, InsetType=0)
mjoin_3 = MeshJoin(Meshes=cull_2)
len = Length(Curve=wbnaked)
mcol = MeshColours(
    Mesh=wbframe,
    Colours=[RGB(127, 255, 0), RGB(0, 100, 0), RGB(34, 139, 34), RGB(124, 252, 0), RGB(154, 205, 50), RGB(173, 255, 47), RGB(50, 205, 50), RGB(152, 251, 152)])
larger_4 = LargerThan(FirstNumber=len, SecondNumber=Slider(527, range=0..1000))  # -> LargerThan, OrEqualTo
preview = CustomPreview(
    Geometry=mcol,
    Material={diffuse=RGB(221, 160, 221), emission=RGB(66, 48, 66), shine=0.5, specular=RGB(255, 255, 255), transparency=0})
c_script = CSharpScript(mesh=mcol)  # -> flatten(base64Draco); inputs mesh: Mesh
# ---------- c_script: C# ----------
    var options = new Rhino.FileIO.DracoCompressionOptions();
    options.CompressionLevel = 5;
    options.IncludeTextureCoordinates = false;
    options.IncludeVertexColors = true;

    var compressed = Rhino.FileIO.DracoCompression.Compress(mesh, options);
    base64Draco = compressed.ToBase64String();
# ---------- end c_script ----------
cull_3 = CullPattern(List=wbnaked, CullPattern=invert(larger_4.LargerThan))  # -> graft(List)
mesh_3 = Mesh(mjoin_3)
disc = Discontinuity(Curve=cull_3, Level=1)  # -> Points, Parameters
py3_8 = Python3Script(mesh=mjoin_3)  # -> out, a; inputs mesh: Mesh; same code as py3_7
wbnaked_2 = WeaverbirdsNakedBoundary(MeshClosedPolylines=mesh_3)
context_bake = ContextBake(Content=c_script)
del_2 = DelaunayMesh(Points=disc.Points, Plane=PlaneXY(0, 0, 0))
len_2 = Length(Curve=wbnaked_2)
mjoin_4 = MeshJoin(Meshes=flatten([del_2, mjoin_2]))
larger_5 = LargerThan(FirstNumber=len_2, SecondNumber=Slider(250, range=0..1000))  # -> LargerThan, OrEqualTo
demesh_2 = DeconstructMesh(Mesh=mjoin_4)  # -> Vertices, Faces, Colours, Normals
cull_4 = CullPattern(List=wbnaked_2, CullPattern=invert(larger_5.LargerThan))  # -> graft(List)
disc_2 = Discontinuity(Curve=cull_4, Level=1)  # -> Points, Parameters
del_3 = DelaunayMesh(Points=disc_2.Points, Plane=PlaneXY(0, 0, 0))
item_3 = ListItem(List=demesh_2.Vertices, Index=py3_7.a, Wrap=True)
cullpt = CullDuplicates(Points=item_3, Tolerance=0.1, CullMode=3)  # -> Points, Indices, Valence
mjoin_5 = MeshJoin(Meshes=flatten([del_3, mjoin_3]))
del_4 = DelaunayMesh(Points=cullpt.Points, Plane=PlaneXY(0, 0, 0))
wbfacepolys = WeaverbirdsFacePolylines(Mesh=del_4)
demesh_3 = DeconstructMesh(Mesh=mjoin_5)  # -> Vertices, Faces, Colours, Normals
mesh_4 = Mesh(mjoin_2)
demesh_4 = DeconstructMesh(Mesh=del_4)  # -> Vertices, Faces, Colours, Normals
area_3 = Area(Geometry=wbfacepolys)  # -> Area, Centroid
meshcp = MeshClosestPoint(Point=area_3.Centroid, Mesh=mesh_4)  # -> Point, Index, Parameter
item_4 = ListItem(List=demesh_3.Vertices, Index=py3_8.a, Wrap=True)
cullpt_2 = CullDuplicates(Points=item_4, Tolerance=0.1, CullMode=3)  # -> Points, Indices, Valence
dist = Distance(PointA=meshcp.Point, PointB=area_3.Centroid)
del_5 = DelaunayMesh(Points=cullpt_2.Points, Plane=PlaneXY(0, 0, 0))
wbfacepolys_2 = WeaverbirdsFacePolylines(Mesh=del_5)
larger_6 = LargerThan(FirstNumber=dist, SecondNumber=Slider(2, range=0..10))  # -> LargerThan, OrEqualTo
mesh_5 = Mesh(mjoin_3)
area_4 = Area(Geometry=wbfacepolys_2)  # -> Area, Centroid
cullf = CullFaces(Mesh=del_4, Pattern=invert(larger_6.OrEqualTo))
meshcp_2 = MeshClosestPoint(Point=area_4.Centroid, Mesh=mesh_5)  # -> Point, Index, Parameter
number_slider_4 = Slider(1000, range=0..1000)
disjoint_3 = DisjointMesh(Mesh=cullf)
dist_2 = Distance(PointA=meshcp_2.Point, PointB=area_4.Centroid)
area_5 = Area(Geometry=disjoint_3)  # -> Area, Centroid
larger_7 = LargerThan(FirstNumber=area_5.Area, SecondNumber=Slider(2000, range=0..10000))  # -> LargerThan, OrEqualTo
larger_8 = LargerThan(FirstNumber=dist_2, SecondNumber=Slider(2, range=0..10))  # -> LargerThan, OrEqualTo
cull_5 = CullPattern(List=disjoint_3, CullPattern=larger_7.LargerThan)
cullf_2 = CullFaces(Mesh=del_5, Pattern=invert(larger_8.OrEqualTo))
disjoint_4 = DisjointMesh(Mesh=cullf_2)
area_6 = Area(Geometry=disjoint_4)  # -> Area, Centroid
meshskeleton = MeshSkeleton(Mesh=cull_5, Smooth=Slider(200, range=0..200))  # -> Skeleton, _3ValenceLines, NakedPoints, AllEndPoints
larger_9 = LargerThan(FirstNumber=area_6.Area, SecondNumber=Slider(1000, range=0..1000))  # -> LargerThan, OrEqualTo
crv_3 = Curve(meshskeleton.Skeleton)
cull_6 = CullPattern(List=disjoint_4, CullPattern=larger_9.LargerThan)
meshskeleton_2 = MeshSkeleton(Mesh=cull_6, Smooth=Slider(200, range=0..200))  # -> Skeleton, _3ValenceLines, NakedPoints, AllEndPoints

crv_4 = Curve(flatten(crv_3))
number_slider_5 = Slider(0.01, range=0..0.01)
end_2 = EndPoints(Curve=crv_4)  # -> Start, End
crv_5 = Curve(crv_4)
pt_4 = Point(end_2.End)
msphereex = MeshSphereEx(Base=pt_4, Radius=Slider(0.25, range=0..1), Count=2)
mcx = MeshCurve(Mesh=graft(msphereex), Curve=crv_5)  # -> Points, Faces
pshift_2 = ShiftPaths(Data=mcx.Points, Offset=-1)
lng_2 = ListLength(List=pshift_2)
equals = Equality(FirstNumber=lng_2, SecondNumber=Slider(1, range=0..1))  # -> Equality, Inequality
cull_7 = CullPattern(List=graft(crv_4), CullPattern=invert(equals.Equality))
crv_6 = Curve(flatten(cull_7))
end_3 = EndPoints(Curve=crv_6)  # -> Start, End
pt_5 = Point(end_3.Start)
crv_7 = Curve(crv_6)
msphereex_2 = MeshSphereEx(Base=pt_5, Radius=Slider(6, range=0..10), Count=5)
mcx_2 = MeshCurve(Mesh=graft(msphereex_2), Curve=crv_7)  # -> Points, Faces
pshift_3 = ShiftPaths(Data=mcx_2.Points, Offset=-1)
lng_3 = ListLength(List=pshift_3)
equals_2 = Equality(FirstNumber=lng_3, SecondNumber=Slider(1, range=0..1))  # -> Equality, Inequality
cull_8 = CullPattern(List=graft(crv_6), CullPattern=invert(equals_2.Equality))

number_slider_6 = Slider(0, range=0..100)
number_slider_7 = Slider(1, range=0..1)  # disabled
number_slider_8 = Slider(1, range=0..1)
crv_8 = Curve(cull_8)
pcol = PolylineCollapse(Polyline=crv_8, Tolerance=Slider(10, range=0..10))  # -> flatten(Polyline), Count
explode_2 = Explode(Curve=pcol.Polyline, Recursive=True)  # -> flatten(Segments), Vertices
crv_9 = Curve(explode_2.Segments)
explode_3 = Explode(Curve=crv_9, Recursive=True)  # -> flatten(Segments), Vertices
linegraph = LineGraph(Lines=explode_3.Segments)  # -> TopologyPoints, Nodes, TopologyEdgesU, TopologyEdgesV, Weights, Adj
crv_10 = Curve(explode_3.Segments)
lng_4 = ListLength(List=linegraph.Adj)
number_slider_9 = Slider(8, range=0..10)
number_slider_10 = Slider(8, range=0..10)
equals_3 = Equality(FirstNumber=lng_4, SecondNumber=Slider(1, range=0..1))  # -> Equality, Inequality
cull_9 = CullPattern(List=graft(linegraph.TopologyPoints), CullPattern=equals_3.Equality)  # -> flatten(List)
neg = Negative(Value=number_slider_9)
pt_6 = Point(linegraph.TopologyPoints)
neg_2 = Negative(Value=number_slider_10)
dom = ConstructDomain(DomainStart=number_slider_9, DomainEnd=neg)
dom_2 = ConstructDomain(DomainStart=number_slider_10, DomainEnd=neg_2)
box = CenterBox(Base=cull_9, X=dom_2, Y=dom_2, Z=dom_2)
mcx_3 = MeshCurve(Mesh=graft(box), Curve=crv_10)  # -> Points, Faces
pshift_4 = ShiftPaths(Data=mcx_3.Points, Offset=-1)
vec2pt_2 = Vector2Pt(PointA=graft(cull_9), PointB=pshift_4, Unitize=False)  # -> Vector, Length
xy = XYPlane(Origin=Point(0, 0, 0))
rev = Reverse(Vector=vec2pt_2.Vector)
xy_2 = XYPlane(Origin=Point(0, 0, 0))
pt_7 = Point(pt_6)
series = Series(Start=0, Step=1, Count=Slider(3, range=0..100))
series_2 = Series(Start=0, Step=1, Count=Slider(2, range=0..100))
series_3 = Series(Start=0, Step=1, Count=Slider(32, range=0..100))
series_4 = Series(Start=0, Step=1, Count=Slider(32, range=0..100))
boundary = BoundarySurfaces(Edges=crv_2)
custom_mesh_settings = SettingsCustom(
    StitchSeams=Toggle(False),
    SimplePlanes=Toggle(False),
    Refine=Toggle(False),
    MinCount=16,
    MaxCount=400,
    AspectRatio=20,
    MaxDistance=Slider(3, range=0..10),
    MaxAngle=20,
    MinEdge=0,
    MaxEdge=Slider(3, range=0..10))
Z = UnitZ(Factor=1)
Z_2 = UnitZ(Factor=Slider(0.3, range=0..1))
crv_11 = Curve(crv_2)
crv_12 = Curve(crv_2)
mesh_6 = Mesh(wbcatmullclark)
Z_3 = UnitZ(Factor=1)
number_slider_11 = Slider(3, range=0..100)
mesh_7 = Mesh(mesh_6)
mesh_8 = Mesh(mesh_6)
number_slider_12 = Slider(10, range=0..10)
number_slider_13 = Slider(10, range=0..10)
number_slider_14 = Slider(2, range=0..100)
toggle = BooleanToggle(True)
toggle_2 = BooleanToggle(True)
number_slider_15 = Slider(10, range=0..10)
number_slider_16 = Slider(10, range=0..10)
Z_4 = UnitZ(Factor=1)
Z_5 = UnitZ(Factor=Slider(100, range=0..100))
rev_2 = Reverse(Vector=Z_5)
number_slider_17 = Slider(500, range=0..1000)
Z_6 = UnitZ(Factor=Slider(5000, range=0..10000))
panel_15 = Panel("""mallacolorconcavidad
cdata
colorpendiente
pdata""")
Z_7 = UnitZ(Factor=Slider(2, range=0..10))
pt_8 = ConstructPoint(XCoordinate=0, YCoordinate=0, ZCoordinate=0)
mesh_9 = Mesh()  # disabled
wbnaked_3 = WeaverbirdsNakedBoundary(MeshClosedPolylines=mesh_9)  # disabled
concavity_3 = Concavity()  # -> Mesh, Colors, Tags, Concavity; disabled
cp = ControlPoints(Curve=wbnaked_3)  # -> Points, Weights, Knots; disabled
path_3 = FilePath("C:\Gravitacional\li")  # disabled
number_slider_18 = Slider(14, range=0..100)  # disabled
pdecon = Deconstruct(Point=cp.Points)  # -> XComponent, YComponent, ZComponent; disabled
sort = SortList(Keys=pdecon.ZComponent)  # -> Keys, ValuesA; disabled
file = ReadFile(File=path_3, PerLineParse=True)  # disabled
slope_2 = Slope()  # -> Mesh, Colors, Tags, Slope; disabled
item_5 = ListItem(List=sort.Keys, Index=0, Wrap=True)  # disabled
subtraction = Subtraction(A=item_5, B=number_slider_18)  # disabled
pt_9 = ConstructPoint(XCoordinate=pdecon.XComponent, YCoordinate=pdecon.YComponent, ZCoordinate=subtraction)  # disabled
pline_2 = PolyLine(Vertices=pt_9, Closed=False)  # disabled
loft = Loft(
    Curves=flatten([wbnaked_3, pline_2]),
    Options={Adjust=False, Closed=False, LoftEnds=0, LoftSimp=0, LoftType=0, Rebuild=10, Refit=0.01})  # disabled
smesh = SimpleMesh(Brep=loft)  # disabled
swatch = ColourSwatch(SwatchColor=RGB(0, 0, 0))  # disabled
mcol_2 = MeshColours(Mesh=smesh, Colours=swatch)  # disabled
panel_16 = Panel("C:\Gravitacional\final pagina\json2\Amesh.json")  # disabled
panel_17 = Panel("C:\Gravitacional\final pagina\json2\mesh.json")  # disabled
preview_2 = CustomPreview(Geometry=smesh, Material=swatch)  # disabled
panel_18 = Panel("C:\Gravitacional\final pagina\json2\base.json")  # disabled
toggle_3 = BooleanToggle(False)  # disabled
toggle_4 = BooleanToggle(False)  # disabled
toggle_5 = BooleanToggle(False)  # disabled
py3_9 = Python3Script(mesh=slope_2.Mesh, direccion=panel_16, printm=toggle_3)  # -> out, a; inputs mesh: Mesh, direccion: String, printm: Boolean; disabled
# ---------- py3_9: Python ----------
import rhinoscriptsyntax as rs
import Rhino.Geometry as rg
import json
import ghpythonlib.components as ghcomp

def mesh_to_dict(mesh):
    # Usar DeconstructMesh desde ghpythonlib
    deconstructed = ghcomp.DeconstructMesh(mesh)
    vertices = deconstructed.vertices
    faces = deconstructed.faces
    colours = deconstructed.colours  # Aquí se usa 'colours' en lugar de 'colors'

    if vertices is None or faces is None or colours is None:
        print("Error: Una de las salidas de DeconstructMesh es None.")
        return None
    
    vertex_list = []
    face_list = []
    vertex_colours = []
    
    # Convertir vertices y colores a listas de coordenadas y valores RGB
    for i in range(len(vertices)):
        point = vertices[i]
        vertex_list.append([point.X, point.Y, point.Z])
        
        colour = colours[i]
        vertex_colours.append([colour.R, colour.G, colour.B])
        print(f"Vértice {i}: Color extraído {colour.R}, {colour.G}, {colour.B}")  # Mensaje de depuración
    
    # Convertir las caras en listas de índices
    for face in faces:
        if face.IsTriangle:
            face_list.append([face.A, face.B, face.C])
        elif face.IsQuad:
            face_list.append([face.A, face.B, face.C])
            face_list.append([face.A, face.C, face.D])
    
    return {
        "vertices": vertex_list,
        "faces": face_list,
        "colors": vertex_colours  # Mantenemos el nombre 'colors' para el JSON
    }

def main(mesh, direccion, print_file):
    if not mesh:
        print("Se requiere una malla.")
        return
    
    data = mesh_to_dict(mesh)
    
    if data is None:
        print("Error al descomponer la malla. No se generó el archivo JSON.")
        return
    
    if print_file:
        with open(direccion, 'w') as f:
            json.dump(data, f)
        print(f"Archivo JSON guardado en: {direccion}")
    else:
        print("Archivo no guardado. Cambie 'print' a True para guardar.")
    
    return json.dumps(data)

# Asignar las entradas de Grasshopper
mesh = mesh
direccion = direccion
print_file = print

# Ejecutar la función principal
output = main(mesh, direccion, print_file)
# ---------- end py3_9 ----------
py3_10 = Python3Script(mesh=concavity_3.Mesh, direccion=panel_17, printm=toggle_4)  # -> out, a; inputs mesh: Mesh, direccion: String, printm: Boolean; disabled
# ---------- py3_10: Python ----------
import rhinoscriptsyntax as rs
import Rhino.Geometry as rg
import json
import ghpythonlib.components as ghcomp

def mesh_to_dict(mesh):
    # Usar DeconstructMesh desde ghpythonlib
    deconstructed = ghcomp.DeconstructMesh(mesh)
    vertices = deconstructed.vertices
    faces = deconstructed.faces
    colours = deconstructed.colours

    if vertices is None or faces is None or colours is None:
        print("Error: Una de las salidas de DeconstructMesh es None.")
        return None
    
    vertex_list = []
    face_list = []
    vertex_colours = []
    
    # Convertir vertices y colores a listas de coordenadas y valores RGB
    for i in range(len(vertices)):
        point = vertices[i]
        vertex_list.append([point.X, point.Y, point.Z])
        
        colour = colours[i]
        vertex_colours.append([colour.R, colour.G, colour.B])
    
    # Convertir las caras en listas de índices
    for face in faces:
        if face.IsTriangle:
            face_list.append([face.A, face.B, face.C])
        elif face.IsQuad:
            face_list.append([face.A, face.B, face.C])
            face_list.append([face.A, face.C, face.D])
    
    return {
        "vertices": vertex_list,
        "faces": face_list,
        "colors": vertex_colours
    }

def main(mesh):
    if not mesh:
        print("Se requiere una malla.")
        return None
    
    data = mesh_to_dict(mesh)
    
    if data is None:
        print("Error al descomponer la malla.")
        return None
    
    return json.dumps(data)

# Asignar la entrada de Grasshopper
mesh = mesh

# Ejecutar la función principal y asignar la salida
output = main(mesh)
# ---------- end py3_10 ----------
py3_11 = Python3Script(mesh=mcol_2, direccion=panel_18, printm=toggle_5)  # -> out, a; inputs mesh: Mesh, direccion: String, printm: Boolean; disabled; same code as py3_9
panel_19 = Panel(py3_10.out)  # disabled

crv_13 = Curve(flatten(meshskeleton_2.Skeleton))
number_slider_19 = Slider(0.01, range=0..0.01)
end_4 = EndPoints(Curve=crv_13)  # -> Start, End
crv_14 = Curve(crv_13)
pt_10 = Point(end_4.End)
number_slider_20 = Slider(6, range=0..10)

end_5 = EndPoints(Curve=crv_13)  # -> Start, End; disabled
ln = Line(StartPoint=end_5.Start, EndPoint=end_5.End)  # disabled
linegraph_2 = LineGraph(Lines=ln)  # -> TopologyPoints, Nodes, TopologyEdgesU, TopologyEdgesV, Weights, Adj; disabled
item_6 = ListItem(List=linegraph_2.TopologyPoints, Index=linegraph_2.TopologyEdgesU, Wrap=True)  # disabled
item_7 = ListItem(List=linegraph_2.TopologyPoints, Index=linegraph_2.TopologyEdgesV, Wrap=True)  # disabled
lng_5 = ListLength(List=linegraph_2.Adj)  # disabled
box_2 = CenterBox(Base=pt_10, X=1, Y=1, Z=1)
equals_4 = Equality(FirstNumber=lng_5, SecondNumber=number_slider_7)  # -> Equality, Inequality; disabled
cull_10 = CullPattern(List=simplify(graft(ln)), CullPattern=invert(equals_4.Equality))  # disabled

mcx_4 = MeshCurve(Mesh=graft(box_2), Curve=crv_14)  # -> Points, Faces
pshift_5 = ShiftPaths(Data=mcx_4.Points, Offset=-1)
lng_6 = ListLength(List=pshift_5)
equals_5 = Equality(FirstNumber=lng_6, SecondNumber=Slider(1, range=0..1))  # -> Equality, Inequality
cull_11 = CullPattern(List=graft(crv_13), CullPattern=invert(equals_5.Equality))
crv_15 = Curve(flatten(cull_11))
end_6 = EndPoints(Curve=crv_15)  # -> Start, End
pt_11 = Point(end_6.Start)
crv_16 = Curve(crv_15)

msphereex_3 = MeshSphereEx(Base=pt_11, Radius=number_slider_8, Count=number_slider_8)

mcx_5 = MeshCurve(Mesh=graft(msphereex_3), Curve=crv_16)  # -> Points, Faces
pshift_6 = ShiftPaths(Data=mcx_5.Points, Offset=-1)
lng_7 = ListLength(List=pshift_6)
equals_6 = Equality(FirstNumber=lng_7, SecondNumber=Slider(1, range=0..1))  # -> Equality, Inequality
cull_12 = CullPattern(List=graft(crv_15), CullPattern=invert(equals_6.Equality))

crv_17 = Curve(cull_12)
pcol_2 = PolylineCollapse(Polyline=crv_17, Tolerance=Slider(10, range=0..10))  # -> flatten(Polyline), Count
explode_4 = Explode(Curve=pcol_2.Polyline, Recursive=True)  # -> flatten(Segments), Vertices
crv_18 = Curve(explode_4.Segments)
explode_5 = Explode(Curve=crv_18, Recursive=True)  # -> flatten(Segments), Vertices
linegraph_3 = LineGraph(Lines=explode_5.Segments)  # -> TopologyPoints, Nodes, TopologyEdgesU, TopologyEdgesV, Weights, Adj
crv_19 = Curve(explode_5.Segments)
lng_8 = ListLength(List=linegraph_3.Adj)
equals_7 = Equality(FirstNumber=lng_8, SecondNumber=Slider(1, range=0..1))  # -> Equality, Inequality
cull_13 = CullPattern(List=graft(linegraph_3.TopologyPoints), CullPattern=equals_7.Equality)  # -> flatten(List)
pt_12 = Point(linegraph_3.TopologyPoints)
box_3 = CenterBox(Base=cull_13, X=dom, Y=dom, Z=dom)
mcx_6 = MeshCurve(Mesh=graft(box_3), Curve=crv_19)  # -> Points, Faces
pshift_7 = ShiftPaths(Data=mcx_6.Points, Offset=-1)
vec2pt_3 = Vector2Pt(PointA=graft(cull_13), PointB=pshift_7, Unitize=False)  # -> Vector, Length
vec2pt_4 = Vector2Pt(PointA=graft(cull_13), PointB=pt_6, Unitize=False)  # -> Vector, Length
rev_3 = Reverse(Vector=vec2pt_3.Vector)
vec2pt_5 = Vector2Pt(PointA=graft(cull_9), PointB=pt_12, Unitize=False)  # -> Vector, Length
vlen = VectorLength(Vector=vec2pt_4.Vector)
vlen_2 = VectorLength(Vector=vec2pt_5.Vector)
pt_13 = Point(pt_12)
sort_2 = SortList(Keys=vlen, ValuesA=pt_7)  # -> Keys, ValuesA
sort_3 = SortList(Keys=vlen, ValuesA=vec2pt_4.Vector)  # -> Keys, ValuesA
sort_4 = SortList(Keys=vlen_2, ValuesA=pt_13)  # -> Keys, ValuesA
sort_5 = SortList(Keys=vlen_2, ValuesA=vec2pt_5.Vector)  # -> Keys, ValuesA
item_8 = ListItem(List=sort_3.ValuesA, Index=series_3, Wrap=True)
angle = Angle(VectorA=rev_3, VectorB=item_8, Plane=xy)  # -> Angle, Reflex
item_9 = ListItem(List=sort_2.ValuesA, Index=series_3, Wrap=True)
sort_6 = SortList(Keys=angle.Angle, ValuesA=item_9)  # -> Keys, ValuesA
item_10 = ListItem(List=reverse(sort_6.ValuesA), Index=series, Wrap=True)
item_11 = ListItem(List=sort_6.ValuesA, Index=series, Wrap=True)
item_12 = ListItem(List=sort_5.ValuesA, Index=series_4, Wrap=True)
angle_2 = Angle(VectorA=rev, VectorB=item_12, Plane=xy_2)  # -> Angle, Reflex
item_13 = ListItem(List=sort_4.ValuesA, Index=series_4, Wrap=True)
sort_7 = SortList(Keys=angle_2.Angle, ValuesA=item_13)  # -> Keys, ValuesA
item_14 = ListItem(List=reverse(sort_7.ValuesA), Index=series_2, Wrap=True)
item_15 = ListItem(List=sort_7.ValuesA, Index=series_2, Wrap=True)
merge_2 = Merge(Data1=item_10, Data2=item_11)
ln_2 = Line(StartPoint=merge_2, EndPoint=graft(cull_13))
merge_3 = Merge(Data1=item_14, Data2=item_15)
ln_3 = Line(StartPoint=merge_3, EndPoint=graft(cull_9))
len_3 = Length(Curve=ln_2)
len_4 = Length(Curve=ln_3)
sort_8 = SortList(Keys=len_3, ValuesA=ln_2)  # -> Keys, ValuesA
sort_9 = SortList(Keys=len_4, ValuesA=ln_3)  # -> Keys, ValuesA
panel_20 = Panel(angle_2.Angle)
item_16 = ListItem(List=sort_8.ValuesA, Index=0, Wrap=True)
item_17 = ListItem(List=sort_9.ValuesA, Index=0, Wrap=True)
merge_4 = Merge(Data1=item_17, Data2=crv_19, Data3=crv_10, Data4=item_16)  # -> flatten(Result)
crv_20 = Curve(flatten([explode_3.Segments, item_17]))
join = JoinCurves(Curves=merge_4, Preserve=False)
project_3 = Project(Geometry=join, Plane=PlaneXY(0, 0, 0))  # -> Geometry, Transform
trim = TrimWithRegion(Curve=project_3.Geometry, Region=crv_2)  # -> Inside, Outside
crv_21 = Curve(flatten(trim.Inside))
srfsplit = SurfaceSplit(Surface=boundary, Curves=crv_21)
mesh_10 = MeshBrep(Brep=srfsplit, Settings=custom_mesh_settings)
demesh_5 = DeconstructMesh(Mesh=mesh_10)  # -> Vertices, Faces, Colours, Normals
meshray = MeshRay(Mesh=wbcatmullclark, Point=demesh_5.Vertices, Direction=Z)  # -> Point, Hit
conmesh_2 = ConstructMesh(Vertices=meshray.Point, Faces=demesh_5.Faces)  # -> flatten(Mesh)
area_7 = Area(Geometry=conmesh_2)  # -> flatten(Area), Centroid
bnd = Bounds(Numbers=area_7.Area)
dedomain = DeconstructDomain(Domain=bnd)  # -> Start, End
gradient = Gradient(
    LowerLimit=dedomain.Start,
    UpperLimit=dedomain.End,
    Parameter=area_7.Area,
    stops=[0: RGB(243, 57, 0), 0.1: RGB(236, 27, 60), 0.2: RGB(210, 0, 118), 0.3: RGB(103, 0, 120), 0.4: RGB(39, 72, 161), 0.5: RGB(1, 192, 229), 0.6: RGB(18, 178, 90), 0.7: RGB(79, 186, 8), 0.8: RGB(220, 237, 32), 0.9: RGB(247, 159, 20), 1: RGB(243, 57, 0)])
move = Move(Geometry=conmesh_2, Motion=Z_2)  # -> Geometry, Transform
mcol_3 = MeshColours(Mesh=graft(move.Geometry), Colours=graft(gradient))
mjoin_6 = MeshJoin(Meshes=flatten(mcol_3))
mesh_11 = Mesh(mjoin_6)
area_8 = Area(Geometry=mesh_11)  # -> Area, Centroid
hm_elevacion_media = Python3Script(mesh=mesh_11)  # -> out, a; inputs mesh: Mesh
# ---------- hm_elevacion_media: Python ----------
"""
Provides a scripting component.
    Inputs:
        mesh: Malla de la cuenca
    Output:
        mean_elevation: Elevación media de la cuenca (m)
"""

__author__ = "aniba"
__version__ = "2023.07.13"

import Rhino.Geometry as rg

def calcular_elevacion_media(mesh):
    """
    Calcula la elevación media de una malla.
    
    Parámetros:
    mesh: Malla de la cuenca
    
    Retorno:
    mean_elevation: Elevación media de la cuenca (m)
    """
    if mesh is None:
        return None
    
    # Obtener todos los vértices de la malla
    vertices = mesh.Vertices
    num_vertices = vertices.Count
    
    # Sumar todas las coordenadas Z
    suma_z = sum(vertices[i].Z for i in range(num_vertices))
    
    # Calcular la elevación media
    mean_elevation = suma_z / num_vertices if num_vertices > 0 else 0
    return mean_elevation

# Entrada desde Grasshopper
mesh = mesh  # Malla de la cuenca

# Calcular la elevación media
mean_elevation = calcular_elevacion_media(mesh)

# Salida a Grasshopper
a = mean_elevation  # Elevación media de la cuenca (m)
# ---------- end hm_elevacion_media ----------
a_há = Multiplication(A=area_8.Area, B=0.0001)
a_km² = Multiplication(A=area_8.Area, B=1e-06)
tc_ecuacion_de_giandotii = Python3Script(A=a_km², L=longitud_cauce, H_m=hm_elevacion_media.a)  # -> out, a; inputs A: Double, L: Double, H_m: Double
# ---------- tc_ecuacion_de_giandotii: Python ----------
"""
Provides a scripting component.
    Inputs:
        A: Área de la cuenca (km²)
        L: Longitud del cauce principal (km)
        H_m: Diferencia de elevación (m)
    Output:
        Tc: Tiempo de concentración (minutos)
"""

__author__ = "aniba"
__version__ = "2023.07.13"

import math

def tiempo_concentracion_giandotti(A, L, H_m):
    """
    Calcula el tiempo de concentración usando la ecuación de Giandotti.
    
    Parámetros:
    A: Área de la cuenca (km²)
    L: Longitud del cauce principal (km)
    H_m: Diferencia de elevación (m)
    
    Retorno:
    T_c: Tiempo de concentración (minutos)
    """
    if A is None or L is None or H_m is None:
        return None
    Tc = 60 * ((4 * (A ** 0.5) + 1.5 * L) / (0.8 * (H_m ** 0.5)))
    return Tc

# Entradas desde Grasshopper
A = A  # Área de la cuenca (km²)
L = L  # Longitud del cauce principal (km)
H_m = H_m  # Diferencia de elevación (m)

# Calcular el tiempo de concentración
Tc = tiempo_concentracion_giandotti(A, L, H_m)

# Salida a Grasshopper
a = Tc  # Tiempo de concentración (minutos)
# ---------- end tc_ecuacion_de_giandotii ----------
division = Division(A=tc_ecuacion_de_giandotii.a, B=60)
py3_ecuacion_de_bell = Python3Script(t=tc_ecuacion_de_giandotii.a, T=number_slider_3, P1_10=precipitaciones_acumuladas_diarias_para)  # -> out, a, b; inputs t: Double, T: Double, P1_10: Double
# ---------- py3_ecuacion_de_bell: Python ----------
"""
Provides a scripting component.
    Inputs:
        t: Duración de la lluvia (minutos)
        T: Período de retorno (años)
        P1_10: Precipitación con T = 10 años y duración de 1 hora (mm)
    Output:
        PtT: Precipitación (mm) para el período de retorno y duración dados
        ItT: Intensidad (mm/h) para el período de retorno y duración dados
"""

__author__ = "aniba"
__version__ = "2023.07.13"

import math

def calcular_precipitacion(t, T, P1_10):
    """
    Calcula la precipitación usando la ecuación de Bell.
    
    Parámetros:
    t: Duración de la lluvia (minutos)
    T: Período de retorno (años)
    P1_10: Precipitación con T = 10 años y duración de 1 hora (mm)
    
    Retorno:
    PtT: Precipitación (mm) para el período de retorno y duración dados
    ItT: Intensidad (mm/h) para el período de retorno y duración dados
    """
    # Calcular ln(T)
    ln_T = math.log(T)
    
    # Calcular PtT
    PtT = (0.54 * (t ** 0.25) - 0.50) * (0.21 * ln_T + 0.52) * P1_10
    
    # Calcular ItT
    ItT = PtT / (t / 60.0)
    
    return PtT, ItT

# Entradas desde Grasshopper
t = t  # Duración de la lluvia (minutos)
T = T  # Período de retorno (años)
P1_10 = P1_10  # Precipitación con T = 10 años y duración de 1 hora (mm)

# Calcular la precipitación y la intensidad
PtT, ItT = calcular_precipitacion(t, T, P1_10)

# Salidas a Grasshopper
a = PtT  # Precipitación (mm)
b = ItT  # Intensidad (mm/h)
# ---------- end py3_ecuacion_de_bell ----------
pp_mm = Panel(py3_ecuacion_de_bell.a)
i_mm_hr = Panel(py3_ecuacion_de_bell.b)
calculo_de_precipitacion_ec_de_bell = Python3Script(
    t=tc_ecuacion_de_giandotii.a,
    T=number_slider_3,
    P1_10=precipitaciones_acumuladas_diarias_para,
    n=rugosidad_de_manning,
    S=pendiente_canal,
    C=avr_2,
    A=a_há,
    B=ancho_canal)  # -> out, a, b, c, d, e, f, g, h, i; inputs t: Double, T: Double, P1_10: Double, n: Double, S: Double, C: Double, A: Double, B: Double
# ---------- calculo_de_precipitacion_ec_de_bell: Python ----------
"""
Provides a scripting component.
    Inputs:
        t: Duración de la lluvia (minutos)
        T: Período de retorno (años)
        P1_10: Precipitación con T = 10 años y duración de 1 hora (mm)
        n: Coeficiente de rugosidad de Manning
        S: Pendiente del canal (m/m)
        C: Coeficiente de escorrentía
        A: Área de la cuenca (ha)
        B: Ancho del canal (m)
    Output:
        PtT: Precipitación (mm) para el período de retorno y duración dados
        ItT: Intensidad (mm/h) para el período de retorno y duración dados
        Q: Caudal de diseño (m³/s)
        D: Profundidad del canal (m)
        R: Radio hidráulico (m)
        V: Velocidad del flujo (m/s)
        Fr: Número de Froude
        tipo_flujo: Tipo de flujo (subcrítico, crítico, supercrítico)
        E: Energía específica (m)
"""

__author__ = "aniba"
__version__ = "2023.07.13"

import math

def calcular_precipitacion(t, T, P1_10):
    """
    Calcula la precipitación usando la ecuación de Bell.
    
    Parámetros:
    t: Duración de la lluvia (minutos)
    T: Período de retorno (años)
    P1_10: Precipitación con T = 10 años y duración de 1 hora (mm)
    
    Retorno:
    PtT: Precipitación (mm) para el período de retorno y duración dados
    ItT: Intensidad (mm/h) para el período de retorno y duración dados
    """
    ln_T = math.log(T)
    PtT = (0.54 * (t ** 0.25) - 0.50) * (0.21 * ln_T + 0.52) * P1_10
    ItT = PtT / (t / 60.0)
    return PtT, ItT

def caudal_diseno(C, I, A):
    """
    Calcula el caudal de diseño usando el método racional.
    
    Parámetros:
    C: Coeficiente de escorrentía
    I: Intensidad de la lluvia (mm/h)
    A: Área de la cuenca (ha)
    
    Retorno:
    Q: Caudal de diseño (m³/s)
    """
    I_m_s = I / 3600000  # 1 mm/h = 1/3600000 m/s
    A_m2 = A * 10000     # 1 ha = 10000 m²
    Q_d = C * I_m_s * A_m2
    return Q_d

def dimensionar_canal(Q, n, S, B):
    """
    Dimensiona un canal trapezoidal usando la fórmula de Manning.
    
    Parámetros:
    Q: Caudal de diseño (m³/s)
    n: Coeficiente de rugosidad de Manning
    S: Pendiente del canal (m/m)
    B: Ancho del canal (m)
    
    Retorno:
    D: Profundidad del canal (m)
    A: Área hidráulica (m²)
    P: Perímetro mojado (m)
    R: Radio hidráulico (m)
    V: Velocidad del flujo (m/s)
    Fr: Número de Froude
    tipo_flujo: Tipo de flujo (subcrítico, crítico, supercrítico)
    E: Energía específica (m)
    """
    if Q <= 0 or n <= 0 or S <= 0 or B <= 0:
        return None, None, None, None, None, None, None, None
    
    D = 0.1  # Profundidad inicial (m)
    error = 1e-6  # Tolerancia para la iteración
    max_iter = 1000  # Máximo número de iteraciones
    iter_count = 0

    while iter_count < max_iter:
        A = B * D  # Área hidráulica
        P = B + 2 * D  # Perímetro mojado
        R = A / P  # Radio hidráulico
        V = (1 / n) * (R ** (2/3)) * (S ** 0.5)  # Velocidad del flujo
        Q_calc = V * A  # Caudal calculado
        
        if abs(Q_calc - Q) < error:
            break
        
        D = D * (Q / Q_calc) ** (3/5)
        iter_count += 1
    
    Fr = V / math.sqrt(9.81 * D)  # Número de Froude
    tipo_flujo = "subcrítico" if Fr < 1 else "crítico" if Fr == 1 else "supercrítico"
    E = D + (V ** 2) / (2 * 9.81)  # Energía específica
    
    return D, A, P, R, V, Fr, tipo_flujo, E

# Entradas desde Grasshopper
t = t  # Duración de la lluvia (minutos)
T = T  # Período de retorno (años)
P1_10 = P1_10  # Precipitación con T = 10 años y duración de 1 hora (mm)
n = n  # Coeficiente de rugosidad de Manning
S = S  # Pendiente del canal (m/m)
C = C  # Coeficiente de escorrentía
A = A  # Área de la cuenca (ha)
B = B  # Ancho del canal (m)

# Calcular la precipitación y la intensidad
PtT, ItT = calcular_precipitacion(t, T, P1_10)

# Calcular el caudal de diseño
Q = caudal_diseno(C, ItT, A)

# Dimensionar el canal y calcular las variables adicionales
D, area_hidraulica, perimetro_mojado, radio_hidraulico, velocidad, numero_Froude, tipo_flujo, energia_especifica = dimensionar_canal(Q, n, S, B)

# Salidas a Grasshopper
a = PtT  # Precipitación (mm)
b = ItT  # Intensidad (mm/h)
c = Q  # Caudal de diseño (m³/s)
d = D  # Profundidad del canal (m)
e = radio_hidraulico  # Radio hidráulico (m)
f = velocidad  # Velocidad del flujo (m/s)
g = numero_Froude  # Número de Froude
h = tipo_flujo  # Tipo de flujo (subcrítico, crítico, supercrítico)
i = energia_especifica  # Energía específica (m)
# ---------- end calculo_de_precipitacion_ec_de_bell ----------
metodo_racionalm3 = Python3Script(A=a_há, I=calculo_de_precipitacion_ec_de_bell.b, C=avr_2)  # -> out, a; inputs A: Double, I: Double, C: Double
# ---------- metodo_racionalm3: Python ----------
import ghpythonlib.components as ghcomp

# Entradas
area_cuenca = A  # Área de la cuenca en ha
intensidad_lluvia = I  # Intensidad máxima de lluvia en mm/h
coeficiente_escurrimiento = C  # Coeficiente de escorrentía

# Convertir área de ha a m²
area_cuenca_m2 = area_cuenca * 1e4

# Convertir intensidad de mm/h a m/s
intensidad_lluvia_ms = (intensidad_lluvia / 1000) / 3600

# Calcular el caudal de escurrimiento (Q)
caudal_escurrimiento = coeficiente_escurrimiento * intensidad_lluvia_ms * area_cuenca_m2  # m³/s

# Convertir caudal a volumen acumulable en 1 hora (m³)
volumen_acumulable = caudal_escurrimiento * 3600  # m³

# Salida
a = volumen_acumulable  # Volumen de agua acumulable en m³
# ---------- end metodo_racionalm3 ----------
panel_21 = Panel(metodo_racionalm3.a)
# Precipitación (mm)
# Intensidad (mm/h)
# Caudal de diseño (m³/s)
# Profundidad del canal (m)
# Radio hidráulico (m)
# Velocidad del flujo (m/s)
# Número de Froude
# Tipo de flujo (subcrítico, crítico, supercrítico)
# Energía específica (m)
energia_especifica = Panel(calculo_de_precipitacion_ec_de_bell.i)
tipo_de_flujo = Panel(calculo_de_precipitacion_ec_de_bell.h)
precipitación_en_mm = Panel(calculo_de_precipitacion_ec_de_bell.a)
velocidad_de_flujo = Panel(calculo_de_precipitacion_ec_de_bell.f)
numero_de_froude = Panel(calculo_de_precipitacion_ec_de_bell.g)
q_m3_s = Panel(calculo_de_precipitacion_ec_de_bell.c)
profundidad_canal_m = Panel(calculo_de_precipitacion_ec_de_bell.d)
radio_hidraulico = Panel(calculo_de_precipitacion_ec_de_bell.e)
i_mm_hr_2 = Panel(calculo_de_precipitacion_ec_de_bell.b)
panel_22 = Panel(calculo_de_precipitacion_ec_de_bell.out)
data = Data(flatten([precipitación_en_mm, i_mm_hr_2, q_m3_s, profundidad_canal_m, radio_hidraulico, velocidad_de_flujo, numero_de_froude, tipo_de_flujo, energia_especifica]))
move_2 = Move(Geometry=mcol_3, Motion=Z_3)  # -> Geometry, Transform
project_4 = Project(Geometry=crv_20, Plane=PlaneXY(0, 0, 0))  # -> Geometry, Transform
trim_2 = TrimWithRegion(Curve=project_4.Geometry, Region=crv_12)  # -> Inside, Outside
crv_22 = Curve(trim_2.Inside)
join_2 = JoinCurves(Curves=flatten(crv_22), Preserve=False)
mjoin_7 = MeshJoin(Meshes=flatten(mcol_3))
divdist = DivideDistance(Curve=flatten(join_2), Distance=Slider(20, range=0..100))  # -> Points, Tangents, Parameters
move_3 = Move(Geometry=divdist.Points, Motion=rev_2)  # -> Geometry, Transform
meshray_2 = MeshRay(Mesh=mjoin_7, Point=flatten(move_3.Geometry), Direction=Z_4)  # -> Point, Hit
clean = CleanTree(RemoveNulls=True, RemoveInvalid=True, RemoveEmpty=False, Tree=meshray_2.Point)
pt_14 = Point(clean)
pt_15 = Point(clean)
meshcp_3 = MeshClosestPoint(Point=pt_14, Mesh=mesh_7)  # -> Point, Index, Parameter
meshcp_4 = MeshClosestPoint(Point=pt_15, Mesh=mesh_8)  # -> Point, Index, Parameter
py3_12 = Python3Script(
    Mesh=mesh_7,
    Puntos=meshcp_3.Point,
    Avance=Slider(3, range=0..10),
    Pendiente=number_slider_11,
    Sentido=Toggle(False),
    Iteraciones=Slider(100, range=0..1000))  # -> out, drenajes; inputs Mesh: Mesh, Puntos: list of Point3d, Avance: Double, Pendiente: Double, Sentido: Boolean, Iteraciones: Int32
# ---------- py3_12: Python ----------
import Rhino.Geometry as rg
import math

# Variables de entrada de Grasshopper
mesh = Mesh  # Malla de entrada
puntos = Puntos  # Lista de puntos iniciales
avance = Avance  # Distancia de avance
pendiente = Pendiente  # Grado de pendiente (en porcentaje)
sentido = Sentido  # "Derecha" o "Izquierda"
iteraciones = Iteraciones  # Número máximo de iteraciones

def alinear_plano_a_normal(punto, normal):
    """Función para alinear un plano a la normal de la malla."""
    eje_x = rg.Vector3d.CrossProduct(rg.Vector3d.ZAxis, normal)
    eje_x.Unitize()  # Normalizar el vector X
    plano_orientado = rg.Plane(punto, eje_x, normal)
    return plano_orientado

def generar_drenajes(mesh, puntos, avance, pendiente, sentido, iteraciones):
    drenajes = []
    pendiente_rad = math.radians(pendiente)  # Convertir la pendiente a radianes

    # Convertir booleano a cadena si es necesario
    if isinstance(sentido, bool):
        sentido = "derecha" if sentido else "izquierda"

    # Validar el sentido
    if sentido not in ["derecha", "izquierda"]:
        raise ValueError(f"Sentido no válido: {sentido}. Debe ser 'derecha' o 'izquierda'.")

    for p in puntos:
        if isinstance(p, rg.Point3d):
            punto_a = p
        elif isinstance(p, (list, tuple)) and len(p) == 3:
            punto_a = rg.Point3d(p[0], p[1], p[2])
        else:
            raise TypeError("Los puntos deben ser de tipo Point3d o listas/tuplas de tres elementos.")
        
        polyline = [punto_a]

        for i in range(iteraciones):
            # 1. Obtener la normal en el punto A
            mesh_point = mesh.ClosestMeshPoint(punto_a, 0.0)
            normal_malla = mesh.NormalAt(mesh_point)

            # 2. Orientar el plano al vector de la normal de la malla
            plano_base = alinear_plano_a_normal(punto_a, normal_malla)

            # 3. Calcular el ángulo de avance basado en el sentido
            if sentido == "derecha":
                avance_vector = plano_base.XAxis * avance
            else:
                avance_vector = -plano_base.XAxis * avance

            # 4. Desplazar el punto B usando el vector de avance
            punto_b = punto_a + avance_vector

            # 5. Ajustar el punto B en Z según la pendiente
            delta_z = avance * math.tan(pendiente_rad)
            punto_c = rg.Point3d(punto_b.X, punto_b.Y, punto_b.Z + delta_z)

            # 6. Proyectar el punto B sobre la malla para encontrar el siguiente punto
            proyectado = mesh.ClosestPoint(punto_c)
            
            if proyectado is None:
                print(f"Proyección no válida en la iteración {i}")
                break  # Salir del bucle si la proyección falla

            # 7. El punto proyectado será el nuevo A
            punto_d = proyectado

            # 8. Actualizar la polilínea
            polyline.append(punto_d)
            punto_a = punto_d

        # Guardar la polilínea generada si tiene puntos válidos
        if len(polyline) > 1:
            drenajes.append(rg.Polyline(polyline))
        else:
            print("No se generó una polilínea válida para el punto inicial.")
    
    return drenajes

# Asignar las variables de salida de Grasshopper
drenajes = generar_drenajes(mesh, puntos, avance, pendiente, sentido, iteraciones)
# ---------- end py3_12 ----------
py3_13 = Python3Script(
    Mesh=mesh_8,
    Puntos=meshcp_4.Point,
    Avance=Slider(3, range=0..10),
    Pendiente=number_slider_11,
    Sentido=Toggle(True),
    Iteraciones=Slider(100, range=0..1000))  # -> out, drenajes; inputs Mesh: Mesh, Puntos: list of Point3d, Avance: Double, Pendiente: Double, Sentido: Boolean, Iteraciones: Int32; same code as py3_12
brep = Brep(srfsplit)
clean_2 = CleanTree(RemoveNulls=True, RemoveInvalid=True, RemoveEmpty=False, Tree=py3_12.drenajes)
area_9 = Area(Geometry=brep)  # -> Area, Centroid
clean_3 = CleanTree(RemoveNulls=True, RemoveInvalid=True, RemoveEmpty=False, Tree=py3_13.drenajes)
extr = Extrude(Base=brep, Direction=Z_6)
crv_23 = Curve(flatten(clean_3))
crv_24 = Curve(flatten(clean_2))
panel_23 = Panel(extr)
eval = EvaluateLength(Curve=reparameterize(crv_23), Length=Slider(3, range=0..10), Normalized=False)  # -> Point, Tangent, Parameter
eval_2 = EvaluateCurve(Curve=crv_24, Parameter=Slider(0.05, range=0..0.1))  # -> flatten(Point), Tangent, Angle
brepsinc = PointInBreps(Brep=simplify(graft(extr)), Point=eval.Point, Strict=False)  # -> Inside, Index
brepsinc_2 = PointInBreps(Brep=graft(extr), Point=eval_2.Point, Strict=False)  # -> Inside, Index
cull_14 = CullPattern(List=crv_24, CullPattern=simplify(brepsinc_2.Inside))
cull_15 = CullPattern(List=crv_23, CullPattern=simplify(brepsinc.Inside))
trim_3 = TrimWithBreps(Curve=cull_14, Brep=graft(extr))  # -> Inside, Outside
trim_4 = TrimWithBreps(Curve=cull_15, Brep=graft(extr))  # -> Inside, Outside
crv_25 = Curve(py3_13.drenajes)
crv_26 = Curve([trim_4.Inside, trim_3.Inside])
meshpipe = MeshPipe(Curve=crv_26, Radius=Slider(1, range=0..1), Sides=Slider(3, range=0..10), Tolerance=10, Ending=0)  # -> flatten(Mesh)
move_4 = Move(Geometry=meshpipe, Motion=Z_7)  # -> Geometry, Transform
mjoin_8 = MeshJoin(Meshes=flatten([move_4.Geometry, move_2.Geometry]))  # -> flatten(Mesh)
bbox = BoundingBox(Content=mjoin_8, Plane=PlaneXY(0, 0, 0))  # -> Box, Box_2
volume = Volume(Geometry=bbox.Box)  # -> Volume, Centroid
vec2pt_6 = Vector2Pt(PointA=volume.Centroid, PointB=pt_8, Unitize=False)  # -> Vector, Length
move_5 = Move(Geometry=mjoin_8, Motion=vec2pt_6.Vector)  # -> Geometry, Transform
c_script_2 = CSharpScript(mesh=move_5.Geometry)  # -> base64Draco; inputs mesh: Mesh; same code as c_script
context_bake_2 = ContextBake(Content=c_script_2)
