# Grasshopper definition HelloWorld.gh (Grasshopper 1.0.7)

name = GetString("Andy", AtLeast=1, AtMost=1, TreeAccess=False)
concat = Concatenate(FragmentA="Hello ", FragmentB=name, FragmentC="!")
panel = Panel(concat)
context_print = ContextPrint(Message=panel)
