# Grasshopper definition beta23.gh (Grasshopper 1.0.8)
# plug-ins: RhinoCodePluginGH, MeshEdit Components, Topologizer, Weaverbird, Shortest Walk in Gh, Section To XY, SkeletalGraph, NGon_RH8
# Spherical spikey thing

panel = Panel("""[
  { "lat": -36.414751, "lng": -72.511329 },
  { "lat": -36.415254, "lng": -72.512766 },
  { "lat": -36.415266, "lng": -72.514048 },
  { "lat": -36.41583, "lng": -72.515521 },
  { "lat": -36.415858, "lng": -72.516124 },
  { "lat": -36.416431, "lng": -72.518011 },
  { "lat": -36.416573, "lng": -72.51895 },
  { "lat": -36.416403, "lng": -72.519597 },
  { "lat": -36.416389, "lng": -72.521145 },
  { "lat": -36.418564, "lng": -72.521567 },
  { "lat": -36.420214, "lng": -72.521722 },
  { "lat": -36.421316, "lng": -72.520872 },
  { "lat": -36.422568, "lng": -72.519273 },
  { "lat": -36.422834, "lng": -72.517201 },
  { "lat": -36.420746, "lng": -72.512437 },
  { "lat": -36.418379, "lng": -72.511805 },
  { "lat": -36.417377, "lng": -72.511321 },
  { "lat": -36.414751, "lng": -72.511329 }
]""")
crv = Curve(<curve referenced from the Rhino model>)
panel_2 = Panel("""arena
arena limosa
limo
limo arcilloso
arcilla arenosa
arcilla
suelo orgánico""")
panel_3 = Panel("""arena gruesa
arena fina
arena limosa
limo
limo arcilloso
arcilla arenosa
arcilla
suelo orgánico""")
cp = ControlPoints(Curve=crv)  # -> Points, Weights, Knots
panel_4 = Panel("""{
  "lat": -36.6066,
  "lng": -72.1034
}""")
panel_5 = Panel("""Bosque
Pastizales
Área urbana
Área pavimentada""")
panel_6 = Panel("""Suelo arenoso
Suelo arcilloso
N/A""")
panel_7 = Panel("""Seco
Moderado
Húmedo""")
pdecon = Deconstruct(Point=cp.Points)  # -> XComponent, YComponent, ZComponent
area = Area(Geometry=crv)  # -> Area, Centroid
panel_8 = Panel("-33.516607435203, -70.69790092149275")
item = ListItem(List=panel_2, Index=Slider(2, range=0..6), Wrap=True)  # -> flatten(Item)
pdecon_2 = Deconstruct(Point=area.Centroid)  # -> XComponent, YComponent, ZComponent
item_2 = ListItem(List=panel_3, Index=Slider(5, range=0..7), Wrap=True)  # -> flatten(Item)
panel_9 = Panel(panel_4)
húmedad_del_suelo = ListItem(List=panel_7, Index=Slider(1, range=0..2), Wrap=True)
tipo_de_suelo = ListItem(List=panel_6, Index=Slider(1, range=0..2), Wrap=True)
uso_del_suelo = ListItem(List=panel_5, Index=Slider(0, range=0..3), Wrap=True)
utm_to_geo = Python3Script(e=pdecon.XComponent, n=pdecon.YComponent)  # -> out, a, b; inputs e: Double, n: Double
# ---------- utm_to_geo: Python ----------
from pyproj import CRS, Transformer

def utm_to_latlon(x, y, zone_number, is_northern):
    # Determinar el código EPSG basado en la zona y el hemisferio
    if is_northern:
        epsg_code = 32600 + zone_number  # UTM Norte
    else:
        epsg_code = 32700 + zone_number  # UTM Sur

    # Definir los sistemas de coordenadas
    utm_crs = CRS.from_epsg(epsg_code)
    wgs84_crs = CRS.from_epsg(4326)  # WGS84 Lat/Lon

    # Crear el transformador con always_xy=True para asegurar el orden lon, lat
    transformer = Transformer.from_crs(utm_crs, wgs84_crs, always_xy=True)

    # Transformar las coordenadas
    lon, lat = transformer.transform(x, y)

    return lat, lon

# Ejemplo de uso con tus datos específicos
x = e      # Coordenada UTM Este
y = n     # Coordenada UTM Norte
zone_number = 18
is_northern = False  # Hemisferio Sur

# Convertir coordenadas
latitude, longitude = utm_to_latlon(x, y, zone_number, is_northern)

# Asignar la salida a las variables de Grasshopper o tu aplicación
a = latitude
b = longitude

# Imprimir información adicional
print(f"Latitud: {latitude}, Longitud: {longitude}")
# ---------- end utm_to_geo ----------
utm_to_geo_2 = Python3Script(e=pdecon_2.XComponent, n=pdecon_2.YComponent)  # -> out, a, b; inputs e: Double, n: Double; same code as utm_to_geo
# projectId
# projectName
# projectDescription
# userId
# coordinates
# coordinatesCenter            thumbnail           lines
# mesh
# hillsides
# climatic
# soils
# matrix
panel_10 = Panel("\"cad9618d16cbc4b643a97c683bdc6b68\"")
almacenamiento = GetString(item, AtLeast=1, AtMost=1, TreeAccess=False)
number_slider = Slider(1, range=0..1)
diseño = GetBoolean(Toggle(True), AtLeast=1, AtMost=1, FalseValue="False", TreeAccess=False, TrueValue="True")
uso = GetString(uso_del_suelo, AtLeast=1, AtMost=1, TreeAccess=False)
infiltracion = GetString(item_2, AtLeast=1, AtMost=1, TreeAccess=False)
tipo = GetString(tipo_de_suelo, AtLeast=1, AtMost=1, TreeAccess=False)
datosxr = GetBoolean(Toggle(True), AtLeast=1, AtMost=1, FalseValue="False", TreeAccess=False, TrueValue="True")
humedad = GetString(húmedad_del_suelo, AtLeast=1, AtMost=1, TreeAccess=False)
segmentacion = GetBoolean(Toggle(True), AtLeast=1, AtMost=1, FalseValue="False", TreeAccess=False, TrueValue="True")
panel_11 = Panel("""{
  "lat": -36.418858, "lng": -72.51649
}""")
coordinatescenter = GetString(panel_11, AtLeast=1, AtMost=1, TreeAccess=False)
coordinates = GetString(panel, AtLeast=1, AtMost=1, TreeAccess=False)
rep = ReplaceText(Text="  { \"lat\": x, \"lng\": y },", Find="x", Replace=utm_to_geo.a, RecursiveReplace=False)
rep_2 = ReplaceText(Text=rep, Find="y", Replace=utm_to_geo.b, RecursiveReplace=False)
projectdescription = GetString(number_slider, AtLeast=1, AtMost=1, TreeAccess=False)
rep_3 = ReplaceText(Text="  { \"lat\": x, \"lng\": y },", Find="x", Replace=utm_to_geo_2.a, RecursiveReplace=False)
rep_4 = ReplaceText(Text=rep_3, Find="y", Replace=utm_to_geo_2.b, RecursiveReplace=False)
projectname = GetString(number_slider, AtLeast=1, AtMost=1, TreeAccess=False)
projectid = GetString(number_slider, AtLeast=1, AtMost=1, TreeAccess=False)
crv_2 = Curve(<curve referenced from the Rhino model>)  # disabled
userid = GetString(number_slider, AtLeast=1, AtMost=1, TreeAccess=False)
panel_12 = Panel(rep_2)
area_2 = Area(Geometry=crv_2)  # -> Area, Centroid; disabled
panel_13 = Panel(rep_4)
pdecon_3 = Deconstruct(Point=area_2.Centroid)  # -> XComponent, YComponent, ZComponent; disabled
py3 = Python3Script(x=coordinates)  # -> out, a, b; inputs x: String
# ---------- py3: Python ----------
import json

# Inicializa listas para almacenar latitudes y longitudes
latitudes = []
longitudes = []

try:
    # Cargar la lista de coordenadas desde la entrada `x`
    data = json.loads(x)
    
    # Iterar sobre cada elemento en la lista de coordenadas
    for item in data:
        latitudes.append(item["lat"])
        longitudes.append(item["lng"])

    # Asignar las listas de latitudes y longitudes a las salidas
    a = latitudes
    b = longitudes

except json.JSONDecodeError:
    # En caso de error en el formato JSON, se asignan mensajes de error
    a = "Error en el formato JSON"
    b = "Error en el formato JSON"
# ---------- end py3 ----------
py3_2 = Python3Script(x=coordinatescenter)  # -> out, a, b; inputs x: String
# ---------- py3_2: Python ----------
import json

try:
    # Limpiar el string: eliminar caracteres especiales y espacios
    x = x.replace("\r", "").replace("\n", "").strip()
    
    # Reemplazar comillas simples por dobles y asegurar formato JSON
    x = x.replace("'", "\"")
    
    # Parsear JSON (incluyendo casos donde el JSON está anidado como string)
    data = json.loads(x)
    
    # Si el JSON parseado es un string, volver a parsear (para formato B)
    while isinstance(data, str):
        data = json.loads(data)
    
    # Extraer latitud y longitud (manejo directo de claves)
    a = data["lat"]
    b = data["lng"]
    
    # Validar que sean números
    if not isinstance(a, (int, float)) or not isinstance(b, (int, float)):
        a = "Error"
        b = "Error"

# Capturar todos los errores posibles
except (json.JSONDecodeError, KeyError, TypeError, AttributeError):
    a = "Error"
    b = "Error"
# ---------- end py3_2 ----------

geo_to_utm = Python3Script(x=py3.a, y=py3.b)  # -> out, a, b; inputs x: Double, y: Double
# ---------- geo_to_utm: Python ----------
from pyproj import CRS, Transformer

def latlon_to_utm(lat, lon):
    # Determinar la zona UTM en función de la longitud
    zone_number = int((lon + 180) / 6) + 1
    
    # Limitar el número de zona para evitar valores fuera del rango permitido
    zone_number = max(1, min(60, zone_number))

    # Determinar el hemisferio en función de la latitud
    is_northern = lat >= 0

    # Determinar el código EPSG basado en la zona y el hemisferio
    if is_northern:
        epsg_code = 32600 + zone_number  # UTM Norte
    else:
        epsg_code = 32700 + zone_number  # UTM Sur

    # Validar el sistema de coordenadas UTM basado en el EPSG
    try:
        utm_crs = CRS.from_epsg(epsg_code)
    except Exception as e:
        print(f"Error: código EPSG {epsg_code} no válido. Detalle del error: {e}")
        return None, None

    # Definir los sistemas de coordenadas
    wgs84_crs = CRS.from_epsg(4326)  # WGS84 Lat/Lon

    # Crear el transformador con always_xy=True para asegurar el orden lon, lat
    transformer = Transformer.from_crs(wgs84_crs, utm_crs, always_xy=True)

    # Transformar las coordenadas
    utm_x, utm_y = transformer.transform(lon, lat)

    return utm_x, utm_y

# Convertir coordenadas usando las entradas de Grasshopper
utm_x, utm_y = latlon_to_utm(x, y)

# Asignar la salida a las variables de Grasshopper
a = utm_x
b = utm_y
# ---------- end geo_to_utm ----------
utm_to_geo_3 = Python3Script(e=pdecon_3.XComponent, n=pdecon_3.YComponent)  # -> out, a, b; inputs e: Double, n: Double; disabled; same code as utm_to_geo

py3_3 = Python3Script(x=py3_2.a, y=py3_2.b)  # -> out, a; inputs x: Double, y: Double
# ---------- py3_3: Python ----------
import math
import os
import tempfile
import urllib.request
from pyproj import CRS, Transformer
import Rhino.Geometry as rg  # Rhino.Geometry para Point3d

def calculate_bounds(latitude, longitude, radius):
    """Calcula los límites geográficos basados en un radio en metros."""
    R = 6378137  # Radio de la Tierra en metros
    radius_in_degrees = radius / R * (180 / math.pi)
    
    min_lat = latitude - radius_in_degrees
    max_lat = latitude + radius_in_degrees
    min_lon = longitude - radius_in_degrees / math.cos(latitude * math.pi / 180)
    max_lon = longitude + radius_in_degrees / math.cos(latitude * math.pi / 180)
    
    return min_lat, max_lat, min_lon, max_lon

def fetch_opentopography_points(latitude, longitude, radius, api_key):
    """Descarga datos de elevación de OpenTopography en formato AAIGrid."""
    min_lat, max_lat, min_lon, max_lon = calculate_bounds(latitude, longitude, radius)
    
    url = (
        f"https://portal.opentopography.org/API/globaldem?demtype=AW3D30"
        f"&south={min_lat}&north={max_lat}&west={min_lon}&east={max_lon}"
        f"&outputFormat=AAIGrid&API_Key={api_key}"
    )
    
    try:
        with urllib.request.urlopen(url) as response:
            if response.status == 200:
                temp_dir = tempfile.gettempdir()
                file_path = os.path.join(temp_dir, "terrain_data.asc")
                with open(file_path, "wb") as file:
                    file.write(response.read())
                return file_path
            else:
                raise Exception(f"Error HTTP: {response.status}, {response.reason}")
    except Exception as e:
        raise Exception(f"Error en la solicitud: {str(e)}")

def extract_points_from_aaigrid(file_path, zone_number, is_northern):
    """Extrae puntos 3D desde un archivo AAIGrid y los convierte a coordenadas UTM."""
    try:
        with open(file_path, 'r') as f:
            header = {}
            data_start = 0
            for i, line in enumerate(f):
                line = line.strip()
                if line.startswith('ncols'): header['ncols'] = int(line.split()[1])
                elif line.startswith('nrows'): header['nrows'] = int(line.split()[1])
                elif line.startswith(('xllcorner', 'xllcenter')): header['xllcorner'] = float(line.split()[1])
                elif line.startswith(('yllcorner', 'yllcenter')): header['yllcorner'] = float(line.split()[1])
                elif line.startswith('cellsize'): header['cellsize'] = float(line.split()[1])
                elif line.startswith('NODATA_value'): header['NODATA_value'] = float(line.split()[1])
                else:
                    data_start = i
                    break
            else:
                raise Exception('Encabezado AAIGrid incompleto')

        # Leer datos de elevación
        data = []
        with open(file_path, 'r') as f:
            for _ in range(data_start): next(f)
            for line in f:
                row = [float(val) for val in line.strip().split()]  # Corrección aquí
                data.append(row)

        nrows, ncols = header['nrows'], header['ncols']
        xllcorner, yllcorner = header['xllcorner'], header['yllcorner']
        cellsize = header['cellsize']
        nodata = header.get('NODATA_value', None)

        # Transformación a UTM
        crs_utm = CRS(proj='utm', zone=zone_number, south=not is_northern)
        transformer = Transformer.from_crs("epsg:4326", crs_utm, always_xy=True)

        points = []
        for row_index in range(nrows):
            y = yllcorner + (nrows - 1 - row_index) * cellsize
            for col_index, z in enumerate(data[row_index]):
                if nodata is not None and z == nodata: continue
                x = xllcorner + col_index * cellsize
                x_utm, y_utm = transformer.transform(x, y)
                points.append(rg.Point3d(x_utm, y_utm, z))
                
        return points
    
    except Exception as e:
        raise Exception(f"Error procesando AAIGrid: {str(e)}")

def get_utm_zone(longitude):
    """Calcula la zona UTM basada en la longitud."""
    return int((longitude + 180) / 6) + 1

# Entradas de Grasshopper
if 'x' in globals() and 'y' in globals():
    latitude = float(x)  # Latitud
    longitude = float(y)  # Longitud
    radius = 600  # Radio en metros
    api_key = "cad9618d16cbc4b643a97c683bdc6b68"  # Clave API

    try:
        file_path = fetch_opentopography_points(latitude, longitude, radius, api_key)
        zone_number = get_utm_zone(longitude)
        is_northern = latitude >= 0
        points = extract_points_from_aaigrid(file_path, zone_number, is_northern)
        a = points  # Salida como lista de Point3d
    except Exception as e:
        print(f"Error: {str(e)}")
        a = []
else:
    print("Por favor, proporciona 'x' (latitud) y 'y' (longitud) como entradas.")
    a = []
# ---------- end py3_3 ----------
pt = ConstructPoint(XCoordinate=geo_to_utm.a, YCoordinate=geo_to_utm.b, ZCoordinate=0)
ins = InsertItems(List=panel_12, Item="[", Indices=0, Wrap=True)
ins_2 = InsertItems(List=reverse(ins), Item="]", Indices=0, Wrap=True)  # -> reverse(List)
path = FilePath("C:\archivos_rhino\Precipitaciones.xlsx")
number_slider_2 = Slider(1, range=0..1)
ins_3 = InsertItems(List=panel_13, Item="[", Indices=0, Wrap=True)
ins_4 = InsertItems(List=reverse(ins_3), Item="]", Indices=0, Wrap=True)  # -> reverse(List)
pline = PolyLine(Vertices=pt, Closed=True)
number_slider_3 = Slider(0.9, range=0..1)
pt_2 = Point(py3_3.a)
panel_14 = Panel(path)
panel_15 = Panel(ins_2)
panel_17 = Panel(ins_4)
del = DelaunayMesh(Points=pt_2, Plane=PlaneXY(0, 0, 0))
wbnaked = WeaverbirdsNakedBoundary(MeshClosedPolylines=del)
project = Project(Geometry=wbnaked, Plane=PlaneXY(0, 0, 0))  # -> Geometry, Transform
area_3 = Area(Geometry=project.Geometry)  # -> Area, Centroid
simplify = SimplifyCurve(Curve=project.Geometry, Tolerance=Slider(10, range=0..10), AngleTolerance=Slider(10, range=0..10))  # -> Curve, Simplified
path_2 = FilePath(panel_14)
wbloop = WeaverbirdsLoopSubdivision(MeshCurves=del, Level=1, SmoothNakedEdges=1)
scale_nu = ScaleNU(Geometry=project.Geometry, Plane=area_3.Centroid, ScaleX=number_slider_3, ScaleY=number_slider_3, ScaleZ=1)  # -> Geometry, Transform
scale_nu_2 = ScaleNU(Geometry=simplify.Curve, Plane=area_3.Centroid, ScaleX=number_slider_3, ScaleY=number_slider_3, ScaleZ=1)  # -> Geometry, Transform
preview = CustomPreview(Geometry=wbloop, Material=ColourSwatch(SwatchColor=RGB(181, 181, 181)))
crv_3 = Curve(scale_nu_2.Geometry)
number_slider_4 = Slider(2, range=0..10)  # disabled
bbox = BoundingBox(Content=wbloop, Plane=PlaneXY(0, 0, 0))  # -> Box, Box_2; disabled
volume = Volume(Geometry=bbox.Box_2)  # -> Volume, Centroid; disabled
longitud_cauce = Slider(6, range=0..10)
number_slider_5 = Slider(10, range=0..100)
scale_nu_3 = ScaleNU(Geometry=wbloop, Plane=volume.Centroid, ScaleX=1, ScaleY=1, ScaleZ=number_slider_4)  # -> Geometry, Transform; disabled
mapeo_coef_escorr_python = Script(x=uso, y=tipo, z=humedad)  # -> out, a; inputs x: String, y: String, z: String
# ---------- mapeo_coef_escorr_python: Python ----------
import sys

sys.path.append(r'C:/archivos_rhino/')

"""Provides a scripting component.
    Inputs:
        x: The x script variable
        y: The y script variable
    Output:
        a: The a output variable"""

__author__ = "aniba"
__version__ = "2023.07.13"

import rhinoscriptsyntax as rs #  MAPEO
runoff_coefficients = {
    ("Bosque", "Suelo arenoso", "Seco"): (0.02, 0.10),
    ("Bosque", "Suelo arenoso", "Moderado"): (0.05, 0.25),
    ("Bosque", "Suelo arenoso", "Húmedo"): (0.25, 0.50),
    ("Bosque", "Suelo arcilloso", "Seco"): (0.10, 0.25),
    ("Bosque", "Suelo arcilloso", "Moderado"): (0.18, 0.35),
    ("Bosque", "Suelo arcilloso", "Húmedo"): (0.35, 0.60),
    ("Pastizales", "Suelo arenoso", "Seco"): (0.02, 0.15),
    ("Pastizales", "Suelo arenoso", "Moderado"): (0.05, 0.20),
    ("Pastizales", "Suelo arenoso", "Húmedo"): (0.20, 0.45),
    ("Pastizales", "Suelo arcilloso", "Seco"): (0.08, 0.20),
    ("Pastizales", "Suelo arcilloso", "Moderado"): (0.13, 0.30),
    ("Pastizales", "Suelo arcilloso", "Húmedo"): (0.30, 0.55),
    ("Área urbana", "Suelo arenoso", "Seco"): (0.05, 0.35),
    ("Área urbana", "Suelo arenoso", "Moderado"): (0.10, 0.50),
    ("Área urbana", "Suelo arenoso", "Húmedo"): (0.50, 0.75),
    ("Área urbana", "Suelo arcilloso", "Seco"): (0.20, 0.60),
    ("Área urbana", "Suelo arcilloso", "Moderado"): (0.30, 0.70),
    ("Área urbana", "Suelo arcilloso", "Húmedo"): (0.70, 0.90),
    ("Área pavimentada", "N/A", "Seco"): (0.60, 0.90),
    ("Área pavimentada", "N/A", "Moderado"): (0.70, 0.95),
    ("Área pavimentada", "N/A", "Húmedo"): (0.85, 0.98)
}

# Tomar como entrada el tipo de suelo, el uso del suelo y las condiciones de humedad del suelo
land_use = x  # 'x' por el nombre de la variable de entrada correspondiente en Grasshopper
soil_type = y  #'y' por el nombre de la variable de entrada correspondiente en Grasshopper
soil_moisture = z  #  'z' por el nombre de la variable de entrada correspondiente en Grasshopper

# Buscar en el diccionario el coeficiente de escorrentía correspondiente
runoff_coefficient = runoff_coefficients.get((land_use, soil_type, soil_moisture))

# Imprimir el coeficiente de escorrentía
print(runoff_coefficient)
# ---------- end mapeo_coef_escorr_python ----------
slope = Slope(Mesh=del)  # -> Mesh, Colors, Tags, Slope; disabled
concavity = Concavity(Mesh=del)  # -> Mesh, Colors, Tags, Concavity
concavity_2 = Concavity(Mesh=wbloop)  # -> Mesh, Colors, Tags, Concavity
rep_5 = ReplaceText(Text=mapeo_coef_escorr_python.out, Find="(", Replace=" ", RecursiveReplace=False)
crv_4 = Curve(crv_3)
rep_6 = ReplaceText(Text=rep_5, Find=")", Replace=" ", RecursiveReplace=False)
demesh = DeconstructMesh(Mesh=slope.Mesh)  # -> Vertices, Faces, Colours, Normals
split = TextSplit(Text=rep_6, Separators=",")
comprobación = Python3Script(x=path_2, y=number_slider_5)  # -> out, a, b; inputs x: String, y: Double
# ---------- comprobación: Python ----------
import rhinoscriptsyntax as rs
import scriptcontext as sc
import System
import System.Collections.Generic
import Rhino
import locale
locale.setlocale(locale.LC_ALL, 'es_ES')

import sys

sys.path.append(r'C:/archivos_rhino/')
import numpy as np
from scipy import stats
from scipy.stats import genextreme, gumbel_r, lognorm, norm, weibull_min
import openpyxl

def is_number(s):
    """ Returns True if string is a number. """
    try:
        float(s)
        return True
    except ValueError:
        return False

def load_excel(path):
    # Cargar el workbook
    try:
        workbook = openpyxl.load_workbook(path, data_only=True)
        sheet = workbook.active  # o workbook[sheet_name] si conoces el nombre de la hoja

        data = []
        for row in sheet.iter_rows(values_only=True):
            # Aseguramos que la columna B (índice 1) sea convertida adecuadamente
            cell = row[1]  # Columna B
            if is_number(cell):
                data.append(float(cell))
            else:
                data.append(np.nan)
        
        return data
    except Exception as e:
        print(f"Error loading Excel file: {e}")
        return []

# Reemplazo 'Precipitaciones.xlsx' con la variable 'x', que debe ser definida fuera de este script
# 'y' es una lista o array de periodos de retorno, definida fuera de este script
if x and y:
    precipitaciones = np.array(load_excel(x))
    if precipitaciones.size == 0:
        a = "No se pudieron cargar datos desde el archivo Excel."
    else:
        # Filtrar out NaN values que pueden interferir con análisis estadísticos
        precipitaciones = precipitaciones[~np.isnan(precipitaciones)]

        if precipitaciones.size == 0:
            a = "No hay datos válidos para analizar después de filtrar NaNs."
        else:
            periodos_retorno = np.array(y, dtype=np.float64)  # Convertimos los periodos a float para evitar conflictos de tipo
            distribuciones = [genextreme, gumbel_r, lognorm, norm]
            results = []
            best_fit = None
            best_p_value = -1  # Inicializamos con un valor imposible para asegurar que cualquier p-value será mayor

            for distribucion in distribuciones:
                distribution_results = "Distribución: {}\n".format(distribucion.name)

                params = distribucion.fit(precipitaciones)
                precipitaciones_retorno = distribucion.ppf(1 - 1 / periodos_retorno, *params)

                # Guardar resultados
                distribution_results += "Periodos de Retorno: {}\n".format(periodos_retorno.tolist())
                distribution_results += "Precipitaciones de Retorno: {}\n".format(precipitaciones_retorno.tolist())

                ks_stat, ks_p_value = stats.kstest(precipitaciones, cdf=distribucion.name, args=params)
                distribution_results += "Kolmogorov-Smirnov Statistic: {:.5f}\n".format(ks_stat)
                distribution_results += "Kolmogorov-Smirnov p-value: {:.5f}\n".format(ks_p_value)

                observed_freq, bin_edges = np.histogram(precipitaciones, bins='auto', density=False)
                expected_freq = distribucion.pdf(bin_edges[:-1], *params) * np.diff(bin_edges) * len(precipitaciones)
                expected_freq = expected_freq.astype(np.float64)  # Asegurarse que expected_freq es float para evitar problemas de tipo
                observed_freq = observed_freq.astype(np.float64)  # Convertir observed_freq a float64 para compatibilidad
                observed_freq *= (sum(expected_freq) / sum(observed_freq))  # Normalize observed frequencies
                chi2_stat, chi2_p_value = stats.chisquare(observed_freq, expected_freq)
                distribution_results += "Chi-squared Statistic: {:.5f}\n".format(chi2_stat)
                distribution_results += "Chi-squared p-value: {:.5f}\n".format(chi2_p_value)

                results.append(distribution_results)

                # Verificar si esta distribución tiene un p-value mayor
                if ks_p_value > best_p_value:
                    best_p_value = ks_p_value
                    best_fit = distribucion

            # Almacenar los resultados en la variable 'a' para salida
            a = "\n".join(results)
            if best_fit is not None:
                b = "La distribución más adecuada es: {}\nCon un p-value de: {:.5f}".format(best_fit.name, best_p_value)
            else:
                b = "No se encontró una distribución adecuada."
# ---------- end comprobación ----------
calcula_pp_maxdiarias = Python3Script(x=path_2, y=number_slider_5)  # -> out, a, b, c; inputs x: String, y: Double
# ---------- calcula_pp_maxdiarias: Python ----------
import sys

sys.path.append(r'C:/archivos_rhino/')

import rhinoscriptsyntax as rs
import scriptcontext as sc
import System
import System.Collections.Generic
import Rhino
import locale
locale.setlocale(locale.LC_ALL, 'es_ES')

import numpy as np
from scipy import stats
from scipy.stats import genextreme, gumbel_r, lognorm, norm, weibull_min
import openpyxl

def is_number(s):
    """ Returns True if string is a number. """
    try:
        float(s)
        return True
    except ValueError:
        return False

def load_excel(path):
    # Cargar el workbook
    try:
        workbook = openpyxl.load_workbook(path, data_only=True)
        sheet = workbook.active  # o workbook[sheet_name] si conoces el nombre de la hoja

        data = []
        for row in sheet.iter_rows(values_only=True):
            # Aseguramos que la columna B (índice 1) sea convertida adecuadamente
            cell = row[1]  # Columna B
            if is_number(cell):
                data.append(float(cell))
            else:
                data.append(np.nan)
        
        return data
    except Exception as e:
        print(f"Error loading Excel file: {e}")
        return []

# Reemplazo 'Precipitaciones.xlsx' con la variable 'x', que debe ser definida fuera de este script
# 'y' es una lista o array de periodos de retorno, definida fuera de este script
if x and y:
    precipitaciones = np.array(load_excel(x))
    if precipitaciones.size == 0:
        a = "No se pudieron cargar datos desde el archivo Excel."
    else:
        # Filtrar out NaN values que pueden interferir con análisis estadísticos
        precipitaciones = precipitaciones[~np.isnan(precipitaciones)]

        if precipitaciones.size == 0:
            a = "No hay datos válidos para analizar después de filtrar NaNs."
        else:
            periodos_retorno = np.array(y, dtype=np.float64)  # Convertimos los periodos a float para evitar conflictos de tipo
            distribuciones = [genextreme, gumbel_r, lognorm, norm]
            results = []
            best_ks_fit = None
            best_ks_p_value = -1  # Inicializamos con un valor imposible para asegurar que cualquier p-value será mayor
            best_chi2_fit = None
            best_chi2_p_value = -1  # Inicializamos con un valor imposible para asegurar que cualquier p-value será mayor

            for distribucion in distribuciones:
                distribution_results = "Distribución: {}\n".format(distribucion.name)

                params = distribucion.fit(precipitaciones)
                precipitaciones_retorno = distribucion.ppf(1 - 1 / periodos_retorno, *params)

                # Guardar resultados
                distribution_results += "Periodos de Retorno: {}\n".format(periodos_retorno.tolist())
                distribution_results += "Precipitaciones de Retorno: {}\n".format(precipitaciones_retorno.tolist())

                ks_stat, ks_p_value = stats.kstest(precipitaciones, cdf=distribucion.name, args=params)
                distribution_results += "Kolmogorov-Smirnov Statistic: {:.5f}\n".format(ks_stat)
                distribution_results += "Kolmogorov-Smirnov p-value: {:.5f}\n".format(ks_p_value)

                observed_freq, bin_edges = np.histogram(precipitaciones, bins='auto', density=False)
                expected_freq = distribucion.pdf(bin_edges[:-1], *params) * np.diff(bin_edges) * len(precipitaciones)
                expected_freq = expected_freq.astype(np.float64)  # Asegurarse que expected_freq es float para evitar problemas de tipo
                observed_freq = observed_freq.astype(np.float64)  # Convertir observed_freq a float64 para compatibilidad
                observed_freq *= (sum(expected_freq) / sum(observed_freq))  # Normalize observed frequencies
                chi2_stat, chi2_p_value = stats.chisquare(observed_freq, expected_freq)
                distribution_results += "Chi-squared Statistic: {:.5f}\n".format(chi2_stat)
                distribution_results += "Chi-squared p-value: {:.5f}\n".format(chi2_p_value)

                results.append(distribution_results)

                # Verificar si esta distribución tiene el mayor p-value de Kolmogorov-Smirnov
                if ks_p_value > best_ks_p_value:
                    best_ks_p_value = ks_p_value
                    best_ks_fit = distribucion

                # Verificar si esta distribución tiene el mayor p-value de chi-cuadrado
                if chi2_p_value > best_chi2_p_value:
                    best_chi2_p_value = chi2_p_value
                    best_chi2_fit = distribucion

            # Almacenar los resultados en la variable 'a' para salida
            a = "\n".join(results)
            if best_ks_fit is not None and best_chi2_fit is not None:
                if best_ks_fit == best_chi2_fit:
                    selected_fit = best_ks_fit
                    b = "La distribución con los mayores p-values tanto de Kolmogorov-Smirnov como de Chi-cuadrado es: {}\n".format(selected_fit.name)
                    b += "Con un p-value de Kolmogorov-Smirnov de: {:.5f} y un p-value de Chi-cuadrado de: {:.5f}".format(best_ks_p_value, best_chi2_p_value)
                else:
                    selected_fit = best_chi2_fit
                    b = "Las distribuciones con los mayores p-values son diferentes.\n"
                    b += "Se elige la distribución con el mayor p-value de Chi-cuadrado: {}\n".format(selected_fit.name)
                    b += "Con un p-value de: {:.5f}".format(best_chi2_p_value)
                
                params = selected_fit.fit(precipitaciones)
                c = selected_fit.ppf(1 - 1 / periodos_retorno, *params).tolist()
            else:
                b = "No se encontraron distribuciones adecuadas."
                c = []
# ---------- end calcula_pp_maxdiarias ----------
py3_4 = Python3Script(mallacolorconcavidad=concavity.Mesh, cdata=concavity.Concavity, colorpendiente=demesh.Colours, pdata=slope.Slope)  # -> out, b; inputs mallacolorconcavidad: Mesh, cdata: Double, colorpendiente: String, pdata: Double; disabled
# ---------- py3_4: Python ----------
import rhinoscriptsyntax as rs
import Rhino.Geometry as rg
import json

def mesh_to_dict(mallacolorconcavidad, cdata, colorpendiente, pdata):
    # Extraer vértices de la malla
    vertex_list = [[v.X, v.Y, v.Z] for v in mallacolorconcavidad.Vertices]
    
    # Extraer colores de los vértices de la malla coloreada (concavidad)
    vertex_colours_concavidad = []
    if mallacolorconcavidad.VertexColors.Count == mallacolorconcavidad.Vertices.Count:
        vertex_colours_concavidad = [[color.R, color.G, color.B] for color in mallacolorconcavidad.VertexColors]
    else:
        # Si no hay colores, asigna blanco por defecto
        vertex_colours_concavidad = [[255, 255, 255]] * len(vertex_list)

    # Extraer las caras de la malla
    face_list = []
    for face in mallacolorconcavidad.Faces:
        if face.IsTriangle:
            face_list.append([face.A, face.B, face.C])
        elif face.IsQuad:
            face_list.append([face.A, face.B, face.C])
            face_list.append([face.A, face.C, face.D])

    # Asegurarse de que colorpendiente tiene el formato adecuado
    color_pendiente_list = [color if isinstance(color, list) and len(color) == 3 else [255, 255, 255] for color in colorpendiente]
    
    # Crear el diccionario final con las estructuras solicitadas
    return {
        "vertices": vertex_list,
        "faces": face_list,
        "colors_concavidad": vertex_colours_concavidad,
        "concavidad_data": cdata,  # Datos de concavidad por vértice
        "colors_pendiente": color_pendiente_list,  # Colores adicionales de la pendiente
        "pendiente_data": pdata  # Datos de pendiente por vértice
    }

def main(mallacolorconcavidad, cdata, colorpendiente, pdata):
    if not mallacolorconcavidad:
        print("Se requiere una malla.")
        return None
    
    data = mesh_to_dict(mallacolorconcavidad, cdata, colorpendiente, pdata)
    
    if data is None:
        print("Error al estructurar los datos de la malla.")
        return None
    
    # Convertir el diccionario a una cadena JSON
    json_string = json.dumps(data)
    return json_string

# Asignar las entradas de Grasshopper
mallacolorconcavidad = mallacolorconcavidad
cdata = cdata
colorpendiente = colorpendiente
pdata = pdata

# Ejecutar la función principal y asignar la salida
b = main(mallacolorconcavidad, cdata, colorpendiente, pdata)  # JSON como string
# ---------- end py3_4 ----------
panel_18 = Panel("""mallacolorconcavidad
cdata
colorpendiente
pdata""")
neg = Negative(Value=Slider(0, range=0..100))
py3_5 = Python3Script(x=split)  # -> out, a; inputs x: Double
# ---------- py3_5: Python ----------
a = x
# ---------- end py3_5 ----------
avr = Average(Input=py3_5.a)
neg_2 = Negative(Value=Slider(0, range=0..100))
larger = LargerThan(FirstNumber=concavity_2.Concavity, SecondNumber=neg_2)  # -> LargerThan, OrEqualTo
larger_2 = LargerThan(FirstNumber=concavity_2.Concavity, SecondNumber=neg)  # -> LargerThan, OrEqualTo
coeficiente_de_escorrentia = Panel(avr)
mesh = Mesh(wbloop)
precipitaciones_acumuladas_diarias_para = Panel(calcula_pp_maxdiarias.c)  # "Precipitaciones acumuladas diarias para 10años"
contour = Contour(Shape=concavity_2.Mesh, Point=Point(0, 0, 0), Direction=Vector(0, 0, 1), Distance=Slider(1, range=0..10))  # disabled
panel_19 = Panel(calcula_pp_maxdiarias.b)
panel_20 = Panel(comprobación.b)
panel_21 = Panel(calcula_pp_maxdiarias.a)
rugosidad_de_manning = Slider(0.025, range=0..0.1)

cullv = CullVertices(Mesh=wbloop, Pattern=invert(larger_2.LargerThan), Shrink=True)
cullv_2 = CullVertices(Mesh=wbloop, Pattern=larger.OrEqualTo, Shrink=True)
c_script = CSharpScript(x=segmentacion)  # inputs x: Boolean
# ---------- c_script: C# usings ----------
using System.Linq;
# ---------- c_script: C# ----------
    Guid target = this.Component.InstanceGuid;

    if(mygroupid == System.Guid.Empty){
      mygroup = (Grasshopper.Kernel.Special.GH_Group) this.GrasshopperDocument.FindObject(mygroupid, true);
      if(mygroup == null || !mygroup.ObjectIDs.Contains(this.Component.InstanceGuid)){
        mygroup = FindFirstGroup(target);
      }
    }

    state = x;
    GrasshopperDocument.ScheduleSolution(5, Callback);
# ---------- c_script: C# additional code ----------
  public Guid mygroupid = System.Guid.Empty;
  public Grasshopper.Kernel.Special.GH_Group mygroup = null;
  public bool state;

  /// <summary>
  /// Find the first group that contains the given component object (Id)
  /// </summary>
  /// <param name="id">Component object Id</param>
  public Grasshopper.Kernel.Special.GH_Group FindFirstGroup(Guid id){
    List<Grasshopper.Kernel.Special.GH_Group> groups = GrasshopperDocument
      .Objects
      .OfType<Grasshopper.Kernel.Special.GH_Group>()
      .Where(gr => gr.ObjectIDs.Contains(id))
      .ToList<Grasshopper.Kernel.Special.GH_Group>();
    if(groups.Count > 0){return groups[0];}else{return null;}
  }

  private void Callback(GH_Document doc){
    foreach(Guid id in mygroup.ObjectIDs){
      if(!id.Equals(this.Component.InstanceGuid)){
        Grasshopper.Kernel.IGH_ActiveObject obj = (Grasshopper.Kernel.IGH_ActiveObject) this.GrasshopperDocument.FindObject(id, true);
        obj.Locked = !state;
        obj.ExpireSolution(false);
      }
    }
  }


  /// <summary>
  /// This method will be called once every solution, before any calls to RunScript.
  /// </summary>
  public override void BeforeRunScript()
  { }
  /// <summary>
  /// This method will be called once every solution, after any calls to RunScript.
  /// </summary>
  public override void AfterRunScript()
  { }
# ---------- end c_script ----------

pendiente_canal = Slider(0.001, range=0..0.01)
ancho_canal = Slider(1, range=0..1)
number_slider_6 = Slider(100, range=0..100)
project_2 = Project(Geometry=cullv_2, Plane=PlaneXY(0, 0, 0))  # -> Geometry, Transform
disjoint = DisjointMesh(Mesh=project_2.Geometry)
project_3 = Project(Geometry=cullv, Plane=PlaneXY(0, 0, 0))  # -> Geometry, Transform
area_4 = Area(Geometry=disjoint)  # -> Area, Centroid
disjoint_2 = DisjointMesh(Mesh=project_3.Geometry)
larger_3 = LargerThan(FirstNumber=area_4.Area, SecondNumber=Slider(1000, range=0..10000))  # -> LargerThan, OrEqualTo
area_5 = Area(Geometry=disjoint_2)  # -> Area, Centroid
cull = CullPattern(List=disjoint, CullPattern=larger_3.LargerThan)
larger_4 = LargerThan(FirstNumber=area_5.Area, SecondNumber=Slider(1000, range=0..10000))  # -> LargerThan, OrEqualTo
cull_2 = CullPattern(List=disjoint_2, CullPattern=larger_4.LargerThan)
cullvertices = MeshCullUnusedVertices(Mesh=cull_2)
cullvertices_2 = MeshCullUnusedVertices(Mesh=cull)
wbnaked_2 = WeaverbirdsNakedBoundary(MeshClosedPolylines=graft(cullvertices))  # -> simplify(NakedCurves)
wbnaked_3 = WeaverbirdsNakedBoundary(MeshClosedPolylines=graft(cullvertices_2))  # -> simplify(NakedCurves)
len = Length(Curve=wbnaked_2)
len_2 = Length(Curve=wbnaked_3)
sort = SortList(Keys=len, ValuesA=wbnaked_2)  # -> Keys, ValuesA
sort_2 = SortList(Keys=len_2, ValuesA=wbnaked_3)  # -> Keys, ValuesA
# All input curves should be closed
# the "Ex" Curves should be inside the "In" Curve
cull_i = CullIndex(List=reverse(sort.ValuesA), Indices=Slider(0, range=0..100), Wrap=True)
# All input curves should be closed
# the "Ex" Curves should be inside the "In" Curve
item_3 = ListItem(List=reverse(sort.ValuesA), Index=0, Wrap=True)
cull_i_2 = CullIndex(List=reverse(sort_2.ValuesA), Indices=Slider(0, range=0..100), Wrap=True)
item_4 = ListItem(List=reverse(sort_2.ValuesA), Index=0, Wrap=True)
smoothpline = SmoothPolyline(Polyline=item_4, Strength=1, Times=Slider(5, range=0..10))
smoothpline_2 = SmoothPolyline(Polyline=cull_i_2, Strength=1, Times=Slider(5, range=0..10))
smoothpline_3 = SmoothPolyline(Polyline=cull_i, Strength=1, Times=Slider(5, range=0..10))
smoothpline_4 = SmoothPolyline(Polyline=item_3, Strength=1, Times=Slider(7, range=0..10))
cp_2 = ControlPoints(Curve=smoothpline)  # -> Points, Weights, Knots
cp_3 = ControlPoints(Curve=smoothpline_2)  # -> Points, Weights, Knots
cp_4 = ControlPoints(Curve=smoothpline_4)  # -> Points, Weights, Knots
cp_5 = ControlPoints(Curve=cull_i)  # -> Points, Weights, Knots
cull_i_3 = CullIndex(List=cp_2.Points, Indices=0, Wrap=True)
cull_i_4 = CullIndex(List=cp_3.Points, Indices=0, Wrap=True)
# Parameters
# (Default parameters are suggested)
number_slider_7 = Slider(0.5, range=0.5..6)
cull_i_5 = CullIndex(List=cp_4.Points, Indices=0, Wrap=True)
cull_i_6 = CullIndex(List=cp_5.Points, Indices=0, Wrap=True)
intcrv = Interpolate(Vertices=cull_i_3, Degree=3, Periodic=True, KnotStyle=1)  # -> Curve, Length, Domain
intcrv_2 = Interpolate(Vertices=cull_i_4, Degree=3, Periodic=True, KnotStyle=1)  # -> Curve, Length, Domain
nurbs = NurbsCurve(Vertices=cull_i_3, Degree=3, Periodic=False)  # -> Curve, Length, Domain
intcrv_3 = Interpolate(Vertices=cull_i_5, Degree=3, Periodic=True, KnotStyle=1)  # -> Curve, Length, Domain
intcrv_4 = Interpolate(Vertices=cull_i_6, Degree=3, Periodic=True, KnotStyle=1)  # -> Curve, Length, Domain
nurbs_2 = NurbsCurve(Vertices=cull_i_5, Degree=3, Periodic=False)  # -> Curve, Length, Domain
clean = CleanTree(RemoveNulls=True, RemoveInvalid=True, RemoveEmpty=False, Tree=intcrv.Curve)
clean_2 = CleanTree(RemoveNulls=True, RemoveInvalid=True, RemoveEmpty=False, Tree=intcrv_2.Curve)
Z = UnitZ(Factor=Slider(500, range=0..1000))
clean_3 = CleanTree(RemoveNulls=True, RemoveInvalid=True, RemoveEmpty=False, Tree=intcrv_4.Curve)
clean_4 = CleanTree(RemoveNulls=True, RemoveInvalid=True, RemoveEmpty=False, Tree=intcrv_3.Curve)
pshift = ShiftPaths(Data=clean_3, Offset=-1)
skgraph = SkeletalGraph(
    InclusionCurve=clean,
    ExlusionCurve=clean_2,
    SimplificationTolerance=Slider(0.5, range=0.5..6),
    DivisionResolution=Slider(10, range=1..10),
    ClearanceTolerance=Slider(0.7, range=0.1..3))
# You can adjust the Curve Simplification
# tolerance "S" and size of the division "N" to get
# less amount of connected polylines
skgraph_2 = SkeletalGraph(
    InclusionCurve=simplify(clean_4),
    ExlusionCurve=pshift,
    SimplificationTolerance=number_slider_7,
    DivisionResolution=Slider(10, range=1..10),
    ClearanceTolerance=Slider(0.7, range=0.1..3))
move = Move(Geometry=skgraph_2, Motion=Z)  # -> Geometry, Transform
explode = Explode(Curve=skgraph_2, Recursive=True)  # -> Segments, Vertices
explode_2 = Explode(Curve=skgraph, Recursive=True)  # -> Segments, Vertices
number_slider_8 = Slider(0.05, range=0..0.1)
number_slider_9 = Slider(0.05, range=0..0.1)
topo = Topologizer(LinesInput=flatten(explode.Segments), Tolerance=Slider(5.55, range=0..10))  # -> L, P, S, E, N, I, O, G
topo_2 = Topologizer(LinesInput=flatten(explode_2.Segments), Tolerance=Slider(5.55, range=0..10))  # -> L, P, S, E, N, I, O, G
shortwalk = ShortestWalk(Curves=topo.L, WantedPath=topo.G)  # -> flatten(ShortestWalk), Succession, Direction, Length
shortwalk_2 = ShortestWalk(Curves=topo_2.L, WantedPath=topo_2.G)  # -> flatten(ShortestWalk), Succession, Direction, Length
explode_3 = Explode(Curve=shortwalk.ShortestWalk, Recursive=True)  # -> Segments, Vertices
explode_4 = Explode(Curve=shortwalk_2.ShortestWalk, Recursive=True)  # -> Segments, Vertices
topo_3 = Topologizer(LinesInput=flatten(explode_4.Segments), Tolerance=Slider(5.55, range=0..10))  # -> L, P, S, E, N, I, O, G
topo_4 = Topologizer(LinesInput=flatten(explode_3.Segments), Tolerance=Slider(5.55, range=0..10))  # -> L, P, S, E, N, I, O, G
topo_5 = Topologizer(LinesInput=flatten(topo_3.G), Tolerance=Slider(0.0001, range=0..0.0001))  # -> L, P, S, E, N, I, O, G
topo_6 = Topologizer(LinesInput=flatten(topo_4.G), Tolerance=Slider(0.0001, range=0..0.0001))  # -> L, P, S, E, N, I, O, G
join = TextJoin(Text=topo_5.N, Join=";")  # -> flatten(Result)
join_2 = TextJoin(Text=topo_6.N, Join=";")  # -> flatten(Result)
shortwalk_3 = ShortestWalk(Curves=topo_3.L, WantedPath=topo_5.L)  # -> flatten(ShortestWalk), Succession, Direction, Length
shortwalk_4 = ShortestWalk(Curves=topo_4.L, WantedPath=topo_6.L)  # -> flatten(ShortestWalk), Succession, Direction, Length
item_5 = ListItem(List=join, Index=topo_5.S, Wrap=True)  # -> graft(Item)
item_6 = ListItem(List=join, Index=topo_5.E, Wrap=True)  # -> graft(Item)
item_7 = ListItem(List=join_2, Index=topo_6.S, Wrap=True)  # -> graft(Item)
item_8 = ListItem(List=join_2, Index=topo_6.E, Wrap=True)  # -> graft(Item)
number_slider_10 = Slider(1, range=0..1)
number_slider_11 = Slider(1, range=0..1)
number_slider_12 = Slider(2, range=0..10)
cp_6 = ControlPoints(Curve=shortwalk_3.ShortestWalk)  # -> Points, Weights, Knots
number_slider_13 = Slider(2, range=0..10)
split_2 = TextSplit(Text=item_5, Separators=";")
cp_7 = ControlPoints(Curve=shortwalk_4.ShortestWalk)  # -> Points, Weights, Knots
split_3 = TextSplit(Text=item_7, Separators=";")
split_4 = TextSplit(Text=item_6, Separators=";")
split_5 = TextSplit(Text=item_8, Separators=";")
lng = ListLength(List=split_2)
lng_2 = ListLength(List=split_4)
lng_3 = ListLength(List=split_3)
lng_4 = ListLength(List=split_5)
larger_5 = LargerThan(FirstNumber=lng, SecondNumber=number_slider_11)  # -> flatten(LargerThan), OrEqualTo
larger_6 = LargerThan(FirstNumber=lng_3, SecondNumber=number_slider_10)  # -> flatten(LargerThan), OrEqualTo
larger_7 = LargerThan(FirstNumber=lng_2, SecondNumber=number_slider_11)  # -> flatten(LargerThan), OrEqualTo
lng_5 = ListLength(List=cp_6.Points)
number_slider_14 = Slider(10, range=0..10)
len_3 = Length(Curve=shortwalk_3.ShortestWalk)
larger_8 = LargerThan(FirstNumber=lng_4, SecondNumber=number_slider_10)  # -> flatten(LargerThan), OrEqualTo
lng_6 = ListLength(List=cp_7.Points)
or = GateOr(A=invert(larger_5.LargerThan), B=invert(larger_7.LargerThan))
larger_9 = LargerThan(FirstNumber=lng_5, SecondNumber=Slider(2, range=0..10))  # -> LargerThan, OrEqualTo
or_2 = GateOr(A=invert(larger_6.LargerThan), B=invert(larger_8.LargerThan))
larger_10 = LargerThan(FirstNumber=lng_6, SecondNumber=Slider(2, range=0..10))  # -> LargerThan, OrEqualTo
larger_11 = LargerThan(FirstNumber=len_3, SecondNumber=Slider(21, range=0..100))  # -> graft(LargerThan), OrEqualTo
and = GateAnd(A=invert(flatten(larger_9.LargerThan)), B=or)
and_2 = GateAnd(A=invert(flatten(larger_10.LargerThan)), B=or_2)
cull_3 = CullPattern(List=shortwalk_3.ShortestWalk, CullPattern=invert(flatten(and)))
cull_4 = CullPattern(List=shortwalk_4.ShortestWalk, CullPattern=invert(flatten(and_2)))
crv_5 = Curve(cull_4)
crv_6 = Curve(cull_3)
crv_7 = Curve(crv_5)
crv_8 = Curve(crv_6)
pcol = PolylineCollapse(Polyline=crv_7, Tolerance=Slider(10, range=0..10))  # -> flatten(Polyline), Count
pcol_2 = PolylineCollapse(Polyline=crv_8, Tolerance=Slider(10, range=0..10))  # -> flatten(Polyline), Count
explode_5 = Explode(Curve=pcol.Polyline, Recursive=True)  # -> flatten(Segments), Vertices
explode_6 = Explode(Curve=pcol_2.Polyline, Recursive=True)  # -> flatten(Segments), Vertices
topo_7 = Topologizer(LinesInput=explode_6.Segments, Tolerance=Slider(0.001, range=0..0.001))  # -> L, P, S, E, N, I, O, G
topo_8 = Topologizer(LinesInput=explode_5.Segments, Tolerance=Slider(0.001, range=0..0.001))  # -> L, P, S, E, N, I, O, G
shortwalk_5 = ShortestWalk(Curves=topo_7.L, WantedPath=topo_7.G)  # -> ShortestWalk, Succession, Direction, Length
shortwalk_6 = ShortestWalk(Curves=topo_8.L, WantedPath=topo_8.G)  # -> ShortestWalk, Succession, Direction, Length
end = EndPoints(Curve=shortwalk_5.ShortestWalk)  # -> Start, End
divdist = DivideDistance(Curve=shortwalk_5.ShortestWalk, Distance=Slider(10, range=0..100))  # -> Points, Tangents, Parameters
ins_5 = InsertItems(List=reverse(divdist.Points), Item=graft(end.End), Indices=0, Wrap=True)
end_2 = EndPoints(Curve=shortwalk_6.ShortestWalk)  # -> Start, End
divdist_2 = DivideDistance(Curve=shortwalk_6.ShortestWalk, Distance=Slider(10, range=0..100))  # -> Points, Tangents, Parameters
ins_6 = InsertItems(List=reverse(divdist_2.Points), Item=graft(end_2.End), Indices=0, Wrap=True)
pline_2 = PolyLine(Vertices=ins_5, Closed=False)
crv_9 = Curve(pline_2)
pline_3 = PolyLine(Vertices=ins_6, Closed=False)
crv_10 = Curve(pline_3)
explode_7 = Explode(Curve=crv_10, Recursive=True)  # -> flatten(Segments), Vertices
explode_8 = Explode(Curve=crv_9, Recursive=True)  # -> flatten(Segments), Vertices
linegraph = LineGraph(Lines=explode_7.Segments)  # -> TopologyPoints, Nodes, TopologyEdgesU, TopologyEdgesV, Weights, Adj
linegraph_2 = LineGraph(Lines=explode_8.Segments)  # -> TopologyPoints, Nodes, TopologyEdgesU, TopologyEdgesV, Weights, Adj
crv_11 = Curve(explode_8.Segments)
crv_12 = Curve(explode_7.Segments)
lng_7 = ListLength(List=linegraph.Adj)
lng_8 = ListLength(List=linegraph_2.Adj)
number_slider_15 = Slider(8, range=0..10)
equals = Equality(FirstNumber=lng_7, SecondNumber=Slider(1, range=0..1))  # -> Equality, Inequality
number_slider_16 = Slider(8, range=0..10)
equals_2 = Equality(FirstNumber=lng_8, SecondNumber=Slider(1, range=0..1))  # -> Equality, Inequality
cull_5 = CullPattern(List=graft(linegraph.TopologyPoints), CullPattern=equals.Equality)  # -> flatten(List)
cull_6 = CullPattern(List=graft(linegraph_2.TopologyPoints), CullPattern=equals_2.Equality)  # -> flatten(List)
neg_3 = Negative(Value=number_slider_15)
pt_3 = Point(linegraph_2.TopologyPoints)
neg_4 = Negative(Value=number_slider_16)
dom = ConstructDomain(DomainStart=number_slider_15, DomainEnd=neg_3)
pt_4 = Point(linegraph.TopologyPoints)
dom_2 = ConstructDomain(DomainStart=number_slider_16, DomainEnd=neg_4)
box = CenterBox(Base=cull_5, X=dom, Y=dom, Z=dom)
box_2 = CenterBox(Base=cull_6, X=dom_2, Y=dom_2, Z=dom_2)
mcx = MeshCurve(Mesh=graft(box), Curve=crv_12)  # -> Points, Faces
mcx_2 = MeshCurve(Mesh=graft(box_2), Curve=crv_11)  # -> Points, Faces
pshift_2 = ShiftPaths(Data=mcx.Points, Offset=-1)
pshift_3 = ShiftPaths(Data=mcx_2.Points, Offset=-1)
vec2pt = Vector2Pt(PointA=graft(cull_5), PointB=pshift_2, Unitize=False)  # -> Vector, Length
vec2pt_2 = Vector2Pt(PointA=graft(cull_6), PointB=pshift_3, Unitize=False)  # -> Vector, Length
vec2pt_3 = Vector2Pt(PointA=graft(cull_5), PointB=pt_3, Unitize=False)  # -> Vector, Length
vec2pt_4 = Vector2Pt(PointA=graft(cull_6), PointB=pt_4, Unitize=False)  # -> Vector, Length
rev = Reverse(Vector=vec2pt.Vector)
xy = XYPlane(Origin=Point(0, 0, 0))
rev_2 = Reverse(Vector=vec2pt_2.Vector)
xy_2 = XYPlane(Origin=Point(0, 0, 0))
vlen = VectorLength(Vector=vec2pt_3.Vector)
pt_5 = Point(pt_3)
vlen_2 = VectorLength(Vector=vec2pt_4.Vector)
pt_6 = Point(pt_4)
sort_3 = SortList(Keys=vlen, ValuesA=pt_5)  # -> Keys, ValuesA
sort_4 = SortList(Keys=vlen, ValuesA=vec2pt_3.Vector)  # -> Keys, ValuesA
series = Series(Start=0, Step=1, Count=Slider(3, range=0..100))
sort_5 = SortList(Keys=vlen_2, ValuesA=pt_6)  # -> Keys, ValuesA
sort_6 = SortList(Keys=vlen_2, ValuesA=vec2pt_4.Vector)  # -> Keys, ValuesA
series_2 = Series(Start=0, Step=1, Count=Slider(100, range=0..100))
series_3 = Series(Start=0, Step=1, Count=Slider(2, range=0..100))
series_4 = Series(Start=0, Step=1, Count=Slider(100, range=0..100))
item_9 = ListItem(List=sort_4.ValuesA, Index=series_2, Wrap=True)
angle = Angle(VectorA=rev, VectorB=item_9, Plane=xy)  # -> Angle, Reflex
item_10 = ListItem(List=sort_3.ValuesA, Index=series_2, Wrap=True)
sort_7 = SortList(Keys=angle.Angle, ValuesA=item_10)  # -> Keys, ValuesA
item_11 = ListItem(List=reverse(sort_7.ValuesA), Index=series, Wrap=True)
item_12 = ListItem(List=sort_7.ValuesA, Index=series, Wrap=True)
item_13 = ListItem(List=sort_6.ValuesA, Index=series_4, Wrap=True)
angle_2 = Angle(VectorA=rev_2, VectorB=item_13, Plane=xy_2)  # -> Angle, Reflex
item_14 = ListItem(List=sort_5.ValuesA, Index=series_4, Wrap=True)
sort_8 = SortList(Keys=angle_2.Angle, ValuesA=item_14)  # -> Keys, ValuesA
item_15 = ListItem(List=sort_8.ValuesA, Index=series_3, Wrap=True)
item_16 = ListItem(List=reverse(sort_8.ValuesA), Index=series_3, Wrap=True)
merge = Merge(Data1=item_11, Data2=item_12)
ln = Line(StartPoint=merge, EndPoint=graft(cull_5))
merge_2 = Merge(Data1=item_16, Data2=item_15)
len_4 = Length(Curve=ln)
ln_2 = Line(StartPoint=merge_2, EndPoint=graft(cull_6))
len_5 = Length(Curve=ln_2)
sort_9 = SortList(Keys=len_4, ValuesA=ln)  # -> Keys, ValuesA
item_17 = ListItem(List=sort_9.ValuesA, Index=[0, 1, 3], Wrap=True)
sort_10 = SortList(Keys=len_5, ValuesA=ln_2)  # -> Keys, ValuesA
panel_22 = Panel(angle_2.Angle)
item_18 = ListItem(List=sort_10.ValuesA, Index=[0, 1, 2], Wrap=True)
end_3 = EndPoints(Curve=item_17)  # -> Start, End
merge_3 = Merge(Data1=end_3.Start, Data2=end_3.End)
cullpt = CullDuplicates(Points=merge_3, Tolerance=0.1, CullMode=3)  # -> Points, Indices, Valence
end_4 = EndPoints(Curve=item_18)  # -> Start, End
del_2 = DelaunayMesh(Points=cullpt.Points, Plane=PlaneXY(0, 0, 0))
merge_4 = Merge(Data1=end_4.Start, Data2=end_4.End)
end_5 = EndPoints(Curve=item_17)  # -> Start, End
area_6 = Area(Geometry=del_2)  # -> Area, Centroid
cullpt_2 = CullDuplicates(Points=merge_4, Tolerance=0.1, CullMode=3)  # -> Points, Indices, Valence
dist = Distance(PointA=area_6.Centroid, PointB=end_5.End)  # -> simplify(Distance)
end_6 = EndPoints(Curve=item_18)  # -> Start, End
del_3 = DelaunayMesh(Points=cullpt_2.Points, Plane=PlaneXY(0, 0, 0))
area_7 = Area(Geometry=del_3)  # -> Area, Centroid
sort_11 = SortList(Keys=dist, ValuesA=simplify(item_17))  # -> Keys, ValuesA
dist_2 = Distance(PointA=area_7.Centroid, PointB=end_6.End)  # -> simplify(Distance)
item_19 = ListItem(List=sort_11.ValuesA, Index=[0, 1], Wrap=True)
len_6 = Length(Curve=item_19)
sort_12 = SortList(Keys=dist_2, ValuesA=simplify(item_18))  # -> Keys, ValuesA
sort_13 = SortList(Keys=len_6, ValuesA=item_19)  # -> Keys, ValuesA
boundary = BoundarySurfaces(Edges=crv_4)
item_20 = ListItem(List=sort_12.ValuesA, Index=[0, 1], Wrap=True)
item_21 = ListItem(List=sort_13.ValuesA, Index=0, Wrap=True)
len_7 = Length(Curve=item_20)
sort_14 = SortList(Keys=len_7, ValuesA=item_20)  # -> Keys, ValuesA
item_22 = ListItem(List=sort_14.ValuesA, Index=0, Wrap=True)
merge_5 = Merge(Data1=item_22, Data2=crv_12, Data3=crv_11, Data4=item_21)  # -> flatten(Result)
crv_13 = Curve(flatten([explode_8.Segments, item_22]))
join_3 = JoinCurves(Curves=merge_5, Preserve=False)
project_4 = Project(Geometry=join_3, Plane=PlaneXY(0, 0, 0))  # -> Geometry, Transform
trim = TrimWithRegion(Curve=project_4.Geometry, Region=crv_4)  # -> Inside, Outside
crv_14 = Curve(flatten(trim.Inside))
srfsplit = SurfaceSplit(Surface=boundary, Curves=crv_14)
custom_mesh_settings = SettingsCustom(
    StitchSeams=Toggle(False),
    SimplePlanes=Toggle(False),
    Refine=Toggle(False),
    MinCount=16,
    MaxCount=400,
    AspectRatio=20,
    MaxDistance=Slider(3, range=0..10),
    MaxAngle=20,
    MinEdge=0,
    MaxEdge=Slider(3, range=0..10))
mesh_2 = MeshBrep(Brep=srfsplit, Settings=custom_mesh_settings)
demesh_2 = DeconstructMesh(Mesh=mesh_2)  # -> Vertices, Faces, Colours, Normals
Z_2 = UnitZ(Factor=1)
meshray = MeshRay(Mesh=wbloop, Point=demesh_2.Vertices, Direction=Z_2)  # -> Point, Hit
conmesh = ConstructMesh(Vertices=meshray.Point, Faces=demesh_2.Faces)  # -> flatten(Mesh)
area_8 = Area(Geometry=conmesh)  # -> flatten(Area), Centroid
bnd = Bounds(Numbers=area_8.Area)
dedomain = DeconstructDomain(Domain=bnd)  # -> Start, End
Z_3 = UnitZ(Factor=Slider(0.3, range=0..1))
gradient = Gradient(
    LowerLimit=dedomain.Start,
    UpperLimit=dedomain.End,
    Parameter=area_8.Area,
    stops=[0: RGB(243, 57, 0), 0.1: RGB(236, 27, 60), 0.2: RGB(210, 0, 118), 0.3: RGB(103, 0, 120), 0.4: RGB(39, 72, 161), 0.5: RGB(1, 192, 229), 0.6: RGB(18, 178, 90), 0.7: RGB(79, 186, 8), 0.8: RGB(220, 237, 32), 0.9: RGB(247, 159, 20), 1: RGB(243, 57, 0)])
move_2 = Move(Geometry=conmesh, Motion=Z_3)  # -> Geometry, Transform
mcol = MeshColours(Mesh=graft(move_2.Geometry), Colours=graft(gradient))
Z_4 = UnitZ(Factor=1)
project_5 = Project(Geometry=crv_13, Plane=PlaneXY(0, 0, 0))  # -> Geometry, Transform
crv_15 = Curve(crv_4)
move_3 = Move(Geometry=mcol, Motion=Z_4)  # -> Geometry, Transform
mjoin = MeshJoin(Meshes=flatten(mcol))
mesh_3 = Mesh(mjoin)
area_9 = Area(Geometry=mesh_3)  # -> Area, Centroid
hm_elevacion_media = Python3Script(mesh=mesh_3)  # -> out, a; inputs mesh: Mesh
# ---------- hm_elevacion_media: Python ----------
"""
Provides a scripting component.
    Inputs:
        mesh: Malla de la cuenca
    Output:
        mean_elevation: Elevación media de la cuenca (m)
"""

__author__ = "aniba"
__version__ = "2023.07.13"

import Rhino.Geometry as rg

def calcular_elevacion_media(mesh):
    """
    Calcula la elevación media de una malla.
    
    Parámetros:
    mesh: Malla de la cuenca
    
    Retorno:
    mean_elevation: Elevación media de la cuenca (m)
    """
    if mesh is None:
        return None
    
    # Obtener todos los vértices de la malla
    vertices = mesh.Vertices
    num_vertices = vertices.Count
    
    # Sumar todas las coordenadas Z
    suma_z = sum(vertices[i].Z for i in range(num_vertices))
    
    # Calcular la elevación media
    mean_elevation = suma_z / num_vertices if num_vertices > 0 else 0
    return mean_elevation

# Entrada desde Grasshopper
mesh = mesh  # Malla de la cuenca

# Calcular la elevación media
mean_elevation = calcular_elevacion_media(mesh)

# Salida a Grasshopper
a = mean_elevation  # Elevación media de la cuenca (m)
# ---------- end hm_elevacion_media ----------
a_há = Multiplication(A=area_9.Area, B=0.0001)
a_km² = Multiplication(A=area_9.Area, B=1e-06)
tc_ecuacion_de_giandotii = Python3Script(A=a_km², L=longitud_cauce, H_m=hm_elevacion_media.a)  # -> out, a; inputs A: Double, L: Double, H_m: Double
# ---------- tc_ecuacion_de_giandotii: Python ----------
"""
Provides a scripting component.
    Inputs:
        A: Área de la cuenca (km²)
        L: Longitud del cauce principal (km)
        H_m: Diferencia de elevación (m)
    Output:
        Tc: Tiempo de concentración (minutos)
"""

__author__ = "aniba"
__version__ = "2023.07.13"

import math

def tiempo_concentracion_giandotti(A, L, H_m):
    """
    Calcula el tiempo de concentración usando la ecuación de Giandotti.
    
    Parámetros:
    A: Área de la cuenca (km²)
    L: Longitud del cauce principal (km)
    H_m: Diferencia de elevación (m)
    
    Retorno:
    T_c: Tiempo de concentración (minutos)
    """
    if A is None or L is None or H_m is None:
        return None
    Tc = 60 * ((4 * (A ** 0.5) + 1.5 * L) / (0.8 * (H_m ** 0.5)))
    return Tc

# Entradas desde Grasshopper
A = A  # Área de la cuenca (km²)
L = L  # Longitud del cauce principal (km)
H_m = H_m  # Diferencia de elevación (m)

# Calcular el tiempo de concentración
Tc = tiempo_concentracion_giandotti(A, L, H_m)

# Salida a Grasshopper
a = Tc  # Tiempo de concentración (minutos)
# ---------- end tc_ecuacion_de_giandotii ----------
division = Division(A=tc_ecuacion_de_giandotii.a, B=60)
py3_ecuacion_de_bell = Python3Script(t=tc_ecuacion_de_giandotii.a, T=number_slider_6, P1_10=precipitaciones_acumuladas_diarias_para)  # -> out, a, b; inputs t: Double, T: Double, P1_10: Double
# ---------- py3_ecuacion_de_bell: Python ----------
"""
Provides a scripting component.
    Inputs:
        t: Duración de la lluvia (minutos)
        T: Período de retorno (años)
        P1_10: Precipitación con T = 10 años y duración de 1 hora (mm)
    Output:
        PtT: Precipitación (mm) para el período de retorno y duración dados
        ItT: Intensidad (mm/h) para el período de retorno y duración dados
"""

__author__ = "aniba"
__version__ = "2023.07.13"

import math

def calcular_precipitacion(t, T, P1_10):
    """
    Calcula la precipitación usando la ecuación de Bell.
    
    Parámetros:
    t: Duración de la lluvia (minutos)
    T: Período de retorno (años)
    P1_10: Precipitación con T = 10 años y duración de 1 hora (mm)
    
    Retorno:
    PtT: Precipitación (mm) para el período de retorno y duración dados
    ItT: Intensidad (mm/h) para el período de retorno y duración dados
    """
    # Calcular ln(T)
    ln_T = math.log(T)
    
    # Calcular PtT
    PtT = (0.54 * (t ** 0.25) - 0.50) * (0.21 * ln_T + 0.52) * P1_10
    
    # Calcular ItT
    ItT = PtT / (t / 60.0)
    
    return PtT, ItT

# Entradas desde Grasshopper
t = t  # Duración de la lluvia (minutos)
T = T  # Período de retorno (años)
P1_10 = P1_10  # Precipitación con T = 10 años y duración de 1 hora (mm)

# Calcular la precipitación y la intensidad
PtT, ItT = calcular_precipitacion(t, T, P1_10)

# Salidas a Grasshopper
a = PtT  # Precipitación (mm)
b = ItT  # Intensidad (mm/h)
# ---------- end py3_ecuacion_de_bell ----------
pp_mm = Panel(py3_ecuacion_de_bell.a)
i_mm_hr = Panel(py3_ecuacion_de_bell.b)
calculo_de_precipitacion_ec_de_bell = Python3Script(
    t=tc_ecuacion_de_giandotii.a,
    T=number_slider_6,
    P1_10=precipitaciones_acumuladas_diarias_para,
    n=rugosidad_de_manning,
    S=pendiente_canal,
    C=avr,
    A=a_há,
    B=ancho_canal)  # -> out, a, b, c, d, e, f, g, h, i; inputs t: Double, T: Double, P1_10: Double, n: Double, S: Double, C: Double, A: Double, B: Double
# ---------- calculo_de_precipitacion_ec_de_bell: Python ----------
"""
Provides a scripting component.
    Inputs:
        t: Duración de la lluvia (minutos)
        T: Período de retorno (años)
        P1_10: Precipitación con T = 10 años y duración de 1 hora (mm)
        n: Coeficiente de rugosidad de Manning
        S: Pendiente del canal (m/m)
        C: Coeficiente de escorrentía
        A: Área de la cuenca (ha)
        B: Ancho del canal (m)
    Output:
        PtT: Precipitación (mm) para el período de retorno y duración dados
        ItT: Intensidad (mm/h) para el período de retorno y duración dados
        Q: Caudal de diseño (m³/s)
        D: Profundidad del canal (m)
        R: Radio hidráulico (m)
        V: Velocidad del flujo (m/s)
        Fr: Número de Froude
        tipo_flujo: Tipo de flujo (subcrítico, crítico, supercrítico)
        E: Energía específica (m)
"""

__author__ = "aniba"
__version__ = "2023.07.13"

import math

def calcular_precipitacion(t, T, P1_10):
    """
    Calcula la precipitación usando la ecuación de Bell.
    
    Parámetros:
    t: Duración de la lluvia (minutos)
    T: Período de retorno (años)
    P1_10: Precipitación con T = 10 años y duración de 1 hora (mm)
    
    Retorno:
    PtT: Precipitación (mm) para el período de retorno y duración dados
    ItT: Intensidad (mm/h) para el período de retorno y duración dados
    """
    ln_T = math.log(T)
    PtT = (0.54 * (t ** 0.25) - 0.50) * (0.21 * ln_T + 0.52) * P1_10
    ItT = PtT / (t / 60.0)
    return PtT, ItT

def caudal_diseno(C, I, A):
    """
    Calcula el caudal de diseño usando el método racional.
    
    Parámetros:
    C: Coeficiente de escorrentía
    I: Intensidad de la lluvia (mm/h)
    A: Área de la cuenca (ha)
    
    Retorno:
    Q: Caudal de diseño (m³/s)
    """
    I_m_s = I / 3600000  # 1 mm/h = 1/3600000 m/s
    A_m2 = A * 10000     # 1 ha = 10000 m²
    Q_d = C * I_m_s * A_m2
    return Q_d

def dimensionar_canal(Q, n, S, B):
    """
    Dimensiona un canal trapezoidal usando la fórmula de Manning.
    
    Parámetros:
    Q: Caudal de diseño (m³/s)
    n: Coeficiente de rugosidad de Manning
    S: Pendiente del canal (m/m)
    B: Ancho del canal (m)
    
    Retorno:
    D: Profundidad del canal (m)
    A: Área hidráulica (m²)
    P: Perímetro mojado (m)
    R: Radio hidráulico (m)
    V: Velocidad del flujo (m/s)
    Fr: Número de Froude
    tipo_flujo: Tipo de flujo (subcrítico, crítico, supercrítico)
    E: Energía específica (m)
    """
    if Q <= 0 or n <= 0 or S <= 0 or B <= 0:
        return None, None, None, None, None, None, None, None
    
    D = 0.1  # Profundidad inicial (m)
    error = 1e-6  # Tolerancia para la iteración
    max_iter = 1000  # Máximo número de iteraciones
    iter_count = 0

    while iter_count < max_iter:
        A = B * D  # Área hidráulica
        P = B + 2 * D  # Perímetro mojado
        R = A / P  # Radio hidráulico
        V = (1 / n) * (R ** (2/3)) * (S ** 0.5)  # Velocidad del flujo
        Q_calc = V * A  # Caudal calculado
        
        if abs(Q_calc - Q) < error:
            break
        
        D = D * (Q / Q_calc) ** (3/5)
        iter_count += 1
    
    Fr = V / math.sqrt(9.81 * D)  # Número de Froude
    tipo_flujo = "subcrítico" if Fr < 1 else "crítico" if Fr == 1 else "supercrítico"
    E = D + (V ** 2) / (2 * 9.81)  # Energía específica
    
    return D, A, P, R, V, Fr, tipo_flujo, E

# Entradas desde Grasshopper
t = t  # Duración de la lluvia (minutos)
T = T  # Período de retorno (años)
P1_10 = P1_10  # Precipitación con T = 10 años y duración de 1 hora (mm)
n = n  # Coeficiente de rugosidad de Manning
S = S  # Pendiente del canal (m/m)
C = C  # Coeficiente de escorrentía
A = A  # Área de la cuenca (ha)
B = B  # Ancho del canal (m)

# Calcular la precipitación y la intensidad
PtT, ItT = calcular_precipitacion(t, T, P1_10)

# Calcular el caudal de diseño
Q = caudal_diseno(C, ItT, A)

# Dimensionar el canal y calcular las variables adicionales
D, area_hidraulica, perimetro_mojado, radio_hidraulico, velocidad, numero_Froude, tipo_flujo, energia_especifica = dimensionar_canal(Q, n, S, B)

# Salidas a Grasshopper
a = PtT  # Precipitación (mm)
b = ItT  # Intensidad (mm/h)
c = Q  # Caudal de diseño (m³/s)
d = D  # Profundidad del canal (m)
e = radio_hidraulico  # Radio hidráulico (m)
f = velocidad  # Velocidad del flujo (m/s)
g = numero_Froude  # Número de Froude
h = tipo_flujo  # Tipo de flujo (subcrítico, crítico, supercrítico)
i = energia_especifica  # Energía específica (m)
# ---------- end calculo_de_precipitacion_ec_de_bell ----------
metodo_racionalm3 = Python3Script(A=a_há, I=calculo_de_precipitacion_ec_de_bell.b, C=avr)  # -> out, a; inputs A: Double, I: Double, C: Double
# ---------- metodo_racionalm3: Python ----------
import ghpythonlib.components as ghcomp

# Entradas
area_cuenca = A  # Área de la cuenca en ha
intensidad_lluvia = I  # Intensidad máxima de lluvia en mm/h
coeficiente_escurrimiento = C  # Coeficiente de escorrentía

# Convertir área de ha a m²
area_cuenca_m2 = area_cuenca * 1e4

# Convertir intensidad de mm/h a m/s
intensidad_lluvia_ms = (intensidad_lluvia / 1000) / 3600

# Calcular el caudal de escurrimiento (Q)
caudal_escurrimiento = coeficiente_escurrimiento * intensidad_lluvia_ms * area_cuenca_m2  # m³/s

# Convertir caudal a volumen acumulable en 1 hora (m³)
volumen_acumulable = caudal_escurrimiento * 3600  # m³

# Salida
a = volumen_acumulable  # Volumen de agua acumulable en m³
# ---------- end metodo_racionalm3 ----------
panel_23 = Panel(metodo_racionalm3.a)
# Precipitación (mm)
# Intensidad (mm/h)
# Caudal de diseño (m³/s)
# Profundidad del canal (m)
# Radio hidráulico (m)
# Velocidad del flujo (m/s)
# Número de Froude
# Tipo de flujo (subcrítico, crítico, supercrítico)
# Energía específica (m)
energia_especifica = Panel(calculo_de_precipitacion_ec_de_bell.i)
tipo_de_flujo = Panel(calculo_de_precipitacion_ec_de_bell.h)
precipitación_en_mm = Panel(calculo_de_precipitacion_ec_de_bell.a)
velocidad_de_flujo = Panel(calculo_de_precipitacion_ec_de_bell.f)
numero_de_froude = Panel(calculo_de_precipitacion_ec_de_bell.g)
q_m3_s = Panel(calculo_de_precipitacion_ec_de_bell.c)
profundidad_canal_m = Panel(calculo_de_precipitacion_ec_de_bell.d)
radio_hidraulico = Panel(calculo_de_precipitacion_ec_de_bell.e)
i_mm_hr_2 = Panel(calculo_de_precipitacion_ec_de_bell.b)
panel_24 = Panel(calculo_de_precipitacion_ec_de_bell.out)
data = Data(flatten([precipitación_en_mm, i_mm_hr_2, q_m3_s, profundidad_canal_m, radio_hidraulico, velocidad_de_flujo, numero_de_froude, tipo_de_flujo, energia_especifica]))
trim_2 = TrimWithRegion(Curve=project_5.Geometry, Region=crv_15)  # -> Inside, Outside
mesh_4 = Mesh(mesh)
crv_16 = Curve(trim_2.Inside)
join_4 = JoinCurves(Curves=flatten(crv_16), Preserve=False)
mjoin_2 = MeshJoin(Meshes=flatten(mcol))
divdist_3 = DivideDistance(Curve=flatten(join_4), Distance=Slider(20, range=0..100))  # -> Points, Tangents, Parameters
Z_5 = UnitZ(Factor=1)
Z_6 = UnitZ(Factor=Slider(100, range=0..100))
rev_3 = Reverse(Vector=Z_6)
move_4 = Move(Geometry=divdist_3.Points, Motion=rev_3)  # -> Geometry, Transform
meshray_2 = MeshRay(Mesh=mjoin_2, Point=flatten(move_4.Geometry), Direction=Z_5)  # -> Point, Hit
clean_5 = CleanTree(RemoveNulls=True, RemoveInvalid=True, RemoveEmpty=False, Tree=meshray_2.Point)
pt_7 = Point(clean_5)

mesh_5 = Mesh(mesh_4)
mesh_6 = Mesh(mesh_5)
pt_8 = Point(pt_7)
number_slider_17 = Slider(3, range=0..100)
pt_9 = Point(pt_8)
number_slider_18 = Slider(10, range=0..10)
number_slider_19 = Slider(10, range=0..10)
meshcp = MeshClosestPoint(Point=pt_9, Mesh=mesh_6)  # -> Point, Index, Parameter
meshcp_2 = MeshClosestPoint(Point=pt_8, Mesh=mesh_5)  # -> Point, Index, Parameter
number_slider_20 = Slider(2, range=0..100)
toggle = BooleanToggle(True)
toggle_2 = BooleanToggle(True)
number_slider_21 = Slider(10, range=0..10)
number_slider_22 = Slider(10, range=0..10)
c_script_2 = CSharpScript(x=diseño)  # inputs x: Boolean; same code as c_script
py3_6 = Python3Script(
    Mesh=mesh_5,
    Puntos=meshcp_2.Point,
    Avance=Slider(3, range=0..10),
    Pendiente=number_slider_17,
    Sentido=Toggle(True),
    Iteraciones=Slider(200, range=0..1000))  # -> out, drenajes; inputs Mesh: Mesh, Puntos: list of Point3d, Avance: Double, Pendiente: Double, Sentido: Boolean, Iteraciones: Int32
# ---------- py3_6: Python ----------
import Rhino.Geometry as rg
import math

# Variables de entrada de Grasshopper
mesh = Mesh  # Malla de entrada
puntos = Puntos  # Lista de puntos iniciales
avance = Avance  # Distancia de avance
pendiente = Pendiente  # Grado de pendiente (en porcentaje)
sentido = Sentido  # "Derecha" o "Izquierda"
iteraciones = Iteraciones  # Número máximo de iteraciones

def alinear_plano_a_normal(punto, normal):
    """Función para alinear un plano a la normal de la malla."""
    eje_x = rg.Vector3d.CrossProduct(rg.Vector3d.ZAxis, normal)
    eje_x.Unitize()  # Normalizar el vector X
    plano_orientado = rg.Plane(punto, eje_x, normal)
    return plano_orientado

def generar_drenajes(mesh, puntos, avance, pendiente, sentido, iteraciones):
    drenajes = []
    pendiente_rad = math.radians(pendiente)  # Convertir la pendiente a radianes

    # Convertir booleano a cadena si es necesario
    if isinstance(sentido, bool):
        sentido = "derecha" if sentido else "izquierda"

    # Validar el sentido
    if sentido not in ["derecha", "izquierda"]:
        raise ValueError(f"Sentido no válido: {sentido}. Debe ser 'derecha' o 'izquierda'.")

    for p in puntos:
        if isinstance(p, rg.Point3d):
            punto_a = p
        elif isinstance(p, (list, tuple)) and len(p) == 3:
            punto_a = rg.Point3d(p[0], p[1], p[2])
        else:
            raise TypeError("Los puntos deben ser de tipo Point3d o listas/tuplas de tres elementos.")
        
        polyline = [punto_a]

        for i in range(iteraciones):
            # 1. Obtener la normal en el punto A
            mesh_point = mesh.ClosestMeshPoint(punto_a, 0.0)
            normal_malla = mesh.NormalAt(mesh_point)

            # 2. Orientar el plano al vector de la normal de la malla
            plano_base = alinear_plano_a_normal(punto_a, normal_malla)

            # 3. Calcular el ángulo de avance basado en el sentido
            if sentido == "derecha":
                avance_vector = plano_base.XAxis * avance
            else:
                avance_vector = -plano_base.XAxis * avance

            # 4. Desplazar el punto B usando el vector de avance
            punto_b = punto_a + avance_vector

            # 5. Ajustar el punto B en Z según la pendiente
            delta_z = avance * math.tan(pendiente_rad)
            punto_c = rg.Point3d(punto_b.X, punto_b.Y, punto_b.Z + delta_z)

            # 6. Proyectar el punto B sobre la malla para encontrar el siguiente punto
            proyectado = mesh.ClosestPoint(punto_c)
            
            if proyectado is None:
                print(f"Proyección no válida en la iteración {i}")
                break  # Salir del bucle si la proyección falla

            # 7. El punto proyectado será el nuevo A
            punto_d = proyectado

            # 8. Actualizar la polilínea
            polyline.append(punto_d)
            punto_a = punto_d

        # Guardar la polilínea generada si tiene puntos válidos
        if len(polyline) > 1:
            drenajes.append(rg.Polyline(polyline))
        else:
            print("No se generó una polilínea válida para el punto inicial.")
    
    return drenajes

# Asignar las variables de salida de Grasshopper
drenajes = generar_drenajes(mesh, puntos, avance, pendiente, sentido, iteraciones)
# ---------- end py3_6 ----------
py3_7 = Python3Script(
    Mesh=mesh_6,
    Puntos=meshcp.Point,
    Avance=Slider(3, range=0..10),
    Pendiente=number_slider_17,
    Sentido=Toggle(False),
    Iteraciones=Slider(200, range=0..1000))  # -> out, drenajes; inputs Mesh: Mesh, Puntos: list of Point3d, Avance: Double, Pendiente: Double, Sentido: Boolean, Iteraciones: Int32; same code as py3_6

number_slider_23 = Slider(500, range=0..1000)
brep = Brep(srfsplit)
Z_7 = UnitZ(Factor=Slider(5000, range=0..10000))
clean_6 = CleanTree(RemoveNulls=True, RemoveInvalid=True, RemoveEmpty=False, Tree=py3_7.drenajes)
area_10 = Area(Geometry=brep)  # -> Area, Centroid
clean_7 = CleanTree(RemoveNulls=True, RemoveInvalid=True, RemoveEmpty=False, Tree=py3_6.drenajes)
extr = Extrude(Base=brep, Direction=Z_7)
crv_17 = Curve(flatten(clean_7))
crv_18 = Curve(flatten(clean_6))
eval = EvaluateLength(Curve=reparameterize(crv_17), Length=Slider(3, range=0..10), Normalized=False)  # -> Point, Tangent, Parameter
crv_19 = Curve(crv_10)
crv_20 = Curve(crv_3)
eval_2 = EvaluateCurve(Curve=crv_18, Parameter=Slider(0.05, range=0..0.1))  # -> flatten(Point), Tangent, Angle
Z_8 = UnitZ(Factor=Slider(10000, range=0..10000))
mesh_7 = Mesh(del)
extr_2 = Extrude(Base=crv_20, Direction=Z_8)
brepsinc = PointInBreps(Brep=simplify(graft(extr)), Point=eval.Point, Strict=False)  # -> Inside, Index
crv_21 = Curve(crv_9)
brepsinc_2 = PointInBreps(Brep=graft(extr), Point=eval_2.Point, Strict=False)  # -> Inside, Index
Z_9 = UnitZ(Factor=1)
cap = CapHoles(Brep=extr_2)
mesh_8 = MeshBrep(
    Brep=cap,
    Settings={GridMaxCount=0, GridMinCount=16, JaggedSeams=False, MaxEdgeLength=0, MinEdgeLength=0.0001, MinTolerance=0, Refine=True, RefineAngle=0, RelativeTolerance=0.65, SimplePlanes=True, Tolerance=0})
mmx = MeshMesh(MeshA=mesh_7, MeshB=mesh_8)
cull_7 = CullPattern(List=crv_18, CullPattern=simplify(brepsinc_2.Inside))
cp_8 = ControlPoints(Curve=crv_21)  # -> Points, Weights, Knots
cp_9 = ControlPoints(Curve=mmx)  # -> Points, Weights, Knots
cull_8 = CullPattern(List=crv_17, CullPattern=simplify(brepsinc.Inside))
cp_10 = ControlPoints(Curve=crv_19)  # -> Points, Weights, Knots
nakededge = MeshNakedEdge(Mesh=del)  # -> V, A, B
meshray_3 = MeshRay(Mesh=mesh_7, Point=cp_8.Points, Direction=Z_9)  # -> Point, Hit
meshray_4 = MeshRay(Mesh=mesh_7, Point=cp_9.Points, Direction=Z_9)  # -> Point, Hit
trim_3 = TrimWithBreps(Curve=cull_7, Brep=graft(extr))  # -> Inside, Outside
meshray_5 = MeshRay(Mesh=mesh_7, Point=cp_10.Points, Direction=Z_9)  # -> Point, Hit
trim_4 = TrimWithBreps(Curve=cull_8, Brep=graft(extr))  # -> Inside, Outside
item_23 = ListItem(List=nakededge.V, Index=nakededge.A, Wrap=True)
item_24 = ListItem(List=nakededge.V, Index=nakededge.B, Wrap=True)
Z_10 = UnitZ(Factor=1)
Z_11 = UnitZ(Factor=1)
pline_4 = PolyLine(Vertices=meshray_5.Point, Closed=False)
pline_5 = PolyLine(Vertices=meshray_3.Point, Closed=False)
pline_6 = PolyLine(Vertices=meshray_4.Point, Closed=False)
Z_12 = UnitZ(Factor=1)
ln_3 = Line(StartPoint=item_23, EndPoint=item_24)
number_slider_24 = Slider(2, range=0..10)
number_slider_25 = Slider(0.5, range=0..1)
crv_22 = Curve([trim_4.Inside, trim_3.Inside])
move_5 = Move(Geometry=pline_5, Motion=Z_10)  # -> Geometry, Transform
move_6 = Move(Geometry=pline_6, Motion=Z_11)  # -> Geometry, Transform
number_slider_26 = Slider(1, range=0..10)
move_7 = Move(Geometry=pline_4, Motion=Z_12)  # -> Geometry, Transform
join_5 = JoinCurves(Curves=ln_3, Preserve=False)
number_slider_27 = Slider(0.001, range=0..0.001)
end_7 = EndPoints(Curve=py3_6.drenajes)  # -> Start, End
crv_23 = Curve(flatten(crv_22))
cp_11 = ControlPoints(Curve=join_5)  # -> Points, Weights, Knots
pt_10 = Point(end_7.Start)
end_8 = EndPoints(Curve=crv_23)  # -> Start, End
pt_11 = Point(graft(end_8.Start))
meshpipe = MeshPipe(Curve=move_6.Geometry, Radius=Slider(2, range=0..10), Sides=number_slider_24, Tolerance=10, Ending=0)
meshpipe_2 = MeshPipe(Curve=move_7.Geometry, Radius=number_slider_26, Sides=number_slider_24, Tolerance=10, Ending=0)
pdecon_4 = Deconstruct(Point=cp_11.Points)  # -> XComponent, YComponent, ZComponent
number_slider_28 = Slider(0, range=0..1)
meshpipe_3 = MeshPipe(Curve=move_5.Geometry, Radius=number_slider_26, Sides=number_slider_24, Tolerance=10, Ending=0)
pt_12 = ConstructPoint(XCoordinate=pdecon_4.XComponent, YCoordinate=pdecon_4.YComponent, ZCoordinate=0)
dist_3 = Distance(PointA=graft(pt_10), PointB=flatten(pt_11))
bnd_2 = Bounds(Numbers=dist_3)
mcol_2 = MeshColours(Mesh=meshpipe_2, Colours=ColourSwatch(SwatchColor=RGB(0, 64, 255)))
mcol_3 = MeshColours(Mesh=meshpipe_3, Colours=ColourSwatch(SwatchColor=RGB(242, 255, 0)))
mcol_4 = MeshColours(Mesh=meshpipe, Colours=ColourSwatch(SwatchColor=RGB(15, 138, 113)))
larger_12 = LargerThan(FirstNumber=dist_3, SecondNumber=Slider(0.04148, range=0..0.1))  # -> LargerThan, OrEqualTo
equals_3 = Equality(FirstNumber=dist_3, SecondNumber=Slider(0, range=0..100))  # -> Equality, Inequality
pline_7 = PolyLine(Vertices=pt_12, Closed=False)
cull_9 = CullPattern(List=crv_23, CullPattern=invert(larger_12.LargerThan))
pshift_4 = ShiftPaths(Data=cull_9, Offset=-1)
meshpipe_4 = MeshPipe(Curve=pshift_4, Radius=Slider(1, range=0..1), Sides=Slider(4, range=0..10), Tolerance=10, Ending=0)  # -> flatten(Mesh)
mesh_9 = Mesh(wbloop)
pt_13 = ConstructPoint(XCoordinate=0, YCoordinate=0, ZCoordinate=0)
loft = Loft(
    Curves=flatten([join_5, pline_7]),
    Options={Adjust=False, Closed=False, LoftEnds=0, LoftSimp=0, LoftType=0, Rebuild=10, Refit=0.01})
Z_13 = UnitZ(Factor=Slider(2, range=0..10))
mcol_5 = MeshColours(Mesh=meshpipe_4, Colours=ColourSwatch(SwatchColor=RGB(0, 212, 42)))
smesh = SimpleMesh(Brep=loft)
move_8 = Move(Geometry=mcol_5, Motion=Z_13)  # -> Geometry, Transform
mjoin_3 = MeshJoin(Meshes=move_8.Geometry)
bbox_2 = BoundingBox(Content=mjoin_3, Plane=PlaneXY(0, 0, 0))  # -> Box, Box_2
volume_2 = Volume(Geometry=bbox_2.Box)  # -> Volume, Centroid
py3_8 = Python3Script(mesh=mesh_9)  # -> out, a, b; inputs mesh: Mesh
# ---------- py3_8: Python ----------
import rhinoscriptsyntax as rs
import Rhino.Geometry as rg
import json

def mesh_to_dict(mesh):
    # Extraer vértices
    vertex_list = [[v.X, v.Y, v.Z] for v in mesh.Vertices]
    
    # Extraer colores de los vértices, si están asignados
    vertex_colours = []
    if mesh.VertexColors.Count == mesh.Vertices.Count:
        for color in mesh.VertexColors:
            vertex_colours.append([color.R, color.G, color.B])
    else:
        # Si no hay colores de vértices, usar un color predeterminado (por ejemplo, blanco)
        vertex_colours = [[255, 255, 255] for _ in range(len(vertex_list))]

    # Extraer las caras como listas de índices
    face_list = []
    for face in mesh.Faces:
        if face.IsTriangle:
            face_list.append([face.A, face.B, face.C])
        elif face.IsQuad:
            face_list.append([face.A, face.B, face.C])
            face_list.append([face.A, face.C, face.D])

    # Crear el diccionario final
    return {
        "vertices": vertex_list,
        "faces": face_list,
        "colors": vertex_colours
    }

def main(mesh):
    if not mesh:
        print("Se requiere una malla.")
        return None
    
    data = mesh_to_dict(mesh)
    
    if data is None:
        print("Error al descomponer la malla.")
        return None
    
    # Convertir el diccionario a una cadena JSON
    json_string = json.dumps(data)
    return json_string

# Asignar la entrada de Grasshopper
mesh = mesh

# Ejecutar la función principal y asignar la salida
output = main(mesh)

# Salidas de Grasshopper
b = output  # JSON como string
# ---------- end py3_8 ----------
vec2pt_5 = Vector2Pt(PointA=volume_2.Centroid, PointB=pt_13, Unitize=False)  # -> Vector, Length
preview_2 = CustomPreview(Geometry=smesh, Material=ColourSwatch(SwatchColor=RGB(0, 0, 0)))
move_9 = Move(Geometry=mjoin_3, Motion=vec2pt_5.Vector)  # -> Geometry, Transform
move_10 = Move(Geometry=move_3.Geometry, Motion=vec2pt_5.Vector)  # -> Geometry, Transform
c_script_3 = CSharpScript(mesh=move_9.Geometry)  # -> base64Draco; inputs mesh: Mesh
# ---------- c_script_3: C# ----------
    var options = new Rhino.FileIO.DracoCompressionOptions();
    options.CompressionLevel = 5;
    options.IncludeTextureCoordinates = false;
    options.IncludeVertexColors = true;

    var compressed = Rhino.FileIO.DracoCompression.Compress(mesh, options);
    base64Draco = compressed.ToBase64String();
# ---------- end c_script_3 ----------
c_script_4 = CSharpScript(mesh=move_10.Geometry)  # -> flatten(base64Draco); inputs mesh: Mesh; same code as c_script_3
context_bake = ContextBake(Content=c_script_3)
context_bake_2 = ContextBake(Hillsides=c_script_4)
context_print = ContextPrint(Genjson=py3_8.b)
context_print_2 = ContextPrint(Matrix=Slider(1, range=0..1))
context_print_3 = ContextPrint(Climatic=metodo_racionalm3.a)
context_print_4 = ContextPrint(Soils=data)
entwine = Entwine(Branch00=mcol_2, Branch01=mcol_3, Branch02=mcol_4, Branch03=smesh, FlattenInputs=True)
move_11 = Move(Geometry=flatten([del, entwine]), Motion=vec2pt_5.Vector)  # -> Geometry, Transform
c_script_5 = CSharpScript(mesh=move_11.Geometry)  # -> base64Draco; inputs mesh: Mesh; same code as c_script_3
context_bake_3 = ContextBake(Content=c_script_5)
mesh_10 = Mesh()  # disabled
wbnaked_4 = WeaverbirdsNakedBoundary(MeshClosedPolylines=mesh_10)  # disabled
concavity_3 = Concavity()  # -> Mesh, Colors, Tags, Concavity; disabled
cp_12 = ControlPoints(Curve=wbnaked_4)  # -> Points, Weights, Knots; disabled
path_3 = FilePath("C:\Gravitacional\li")  # disabled
number_slider_29 = Slider(14, range=0..100)  # disabled
pdecon_5 = Deconstruct(Point=cp_12.Points)  # -> XComponent, YComponent, ZComponent; disabled
sort_15 = SortList(Keys=pdecon_5.ZComponent)  # -> Keys, ValuesA; disabled
file = ReadFile(File=path_3, PerLineParse=True)  # disabled
slope_2 = Slope()  # -> Mesh, Colors, Tags, Slope; disabled
item_25 = ListItem(List=sort_15.Keys, Index=0, Wrap=True)  # disabled
subtraction = Subtraction(A=item_25, B=number_slider_29)  # disabled
pt_14 = ConstructPoint(XCoordinate=pdecon_5.XComponent, YCoordinate=pdecon_5.YComponent, ZCoordinate=subtraction)  # disabled
pline_8 = PolyLine(Vertices=pt_14, Closed=False)  # disabled
loft_2 = Loft(
    Curves=flatten([wbnaked_4, pline_8]),
    Options={Adjust=False, Closed=False, LoftEnds=0, LoftSimp=0, LoftType=0, Rebuild=10, Refit=0.01})  # disabled
smesh_2 = SimpleMesh(Brep=loft_2)  # disabled
swatch = ColourSwatch(SwatchColor=RGB(0, 0, 0))  # disabled
mcol_6 = MeshColours(Mesh=smesh_2, Colours=swatch)  # disabled
panel_25 = Panel("C:\Gravitacional\final pagina\json2\Amesh.json")  # disabled
panel_26 = Panel("C:\Gravitacional\final pagina\json2\mesh.json")  # disabled
preview_3 = CustomPreview(Geometry=smesh_2, Material=swatch)  # disabled
panel_27 = Panel("C:\Gravitacional\final pagina\json2\base.json")  # disabled
toggle_3 = BooleanToggle(False)  # disabled
toggle_4 = BooleanToggle(False)  # disabled
toggle_5 = BooleanToggle(False)  # disabled
py3_9 = Python3Script(mesh=slope_2.Mesh, direccion=panel_25, printm=toggle_3)  # -> out, a; inputs mesh: Mesh, direccion: String, printm: Boolean; disabled
# ---------- py3_9: Python ----------
import rhinoscriptsyntax as rs
import Rhino.Geometry as rg
import json
import ghpythonlib.components as ghcomp

def mesh_to_dict(mesh):
    # Usar DeconstructMesh desde ghpythonlib
    deconstructed = ghcomp.DeconstructMesh(mesh)
    vertices = deconstructed.vertices
    faces = deconstructed.faces
    colours = deconstructed.colours  # Aquí se usa 'colours' en lugar de 'colors'

    if vertices is None or faces is None or colours is None:
        print("Error: Una de las salidas de DeconstructMesh es None.")
        return None
    
    vertex_list = []
    face_list = []
    vertex_colours = []
    
    # Convertir vertices y colores a listas de coordenadas y valores RGB
    for i in range(len(vertices)):
        point = vertices[i]
        vertex_list.append([point.X, point.Y, point.Z])
        
        colour = colours[i]
        vertex_colours.append([colour.R, colour.G, colour.B])
        print(f"Vértice {i}: Color extraído {colour.R}, {colour.G}, {colour.B}")  # Mensaje de depuración
    
    # Convertir las caras en listas de índices
    for face in faces:
        if face.IsTriangle:
            face_list.append([face.A, face.B, face.C])
        elif face.IsQuad:
            face_list.append([face.A, face.B, face.C])
            face_list.append([face.A, face.C, face.D])
    
    return {
        "vertices": vertex_list,
        "faces": face_list,
        "colors": vertex_colours  # Mantenemos el nombre 'colors' para el JSON
    }

def main(mesh, direccion, print_file):
    if not mesh:
        print("Se requiere una malla.")
        return
    
    data = mesh_to_dict(mesh)
    
    if data is None:
        print("Error al descomponer la malla. No se generó el archivo JSON.")
        return
    
    if print_file:
        with open(direccion, 'w') as f:
            json.dump(data, f)
        print(f"Archivo JSON guardado en: {direccion}")
    else:
        print("Archivo no guardado. Cambie 'print' a True para guardar.")
    
    return json.dumps(data)

# Asignar las entradas de Grasshopper
mesh = mesh
direccion = direccion
print_file = print

# Ejecutar la función principal
output = main(mesh, direccion, print_file)
# ---------- end py3_9 ----------
py3_10 = Python3Script(mesh=concavity_3.Mesh, direccion=panel_26, printm=toggle_4)  # -> out, a; inputs mesh: Mesh, direccion: String, printm: Boolean; disabled
# ---------- py3_10: Python ----------
import rhinoscriptsyntax as rs
import Rhino.Geometry as rg
import json
import ghpythonlib.components as ghcomp

def mesh_to_dict(mesh):
    # Usar DeconstructMesh desde ghpythonlib
    deconstructed = ghcomp.DeconstructMesh(mesh)
    vertices = deconstructed.vertices
    faces = deconstructed.faces
    colours = deconstructed.colours

    if vertices is None or faces is None or colours is None:
        print("Error: Una de las salidas de DeconstructMesh es None.")
        return None
    
    vertex_list = []
    face_list = []
    vertex_colours = []
    
    # Convertir vertices y colores a listas de coordenadas y valores RGB
    for i in range(len(vertices)):
        point = vertices[i]
        vertex_list.append([point.X, point.Y, point.Z])
        
        colour = colours[i]
        vertex_colours.append([colour.R, colour.G, colour.B])
    
    # Convertir las caras en listas de índices
    for face in faces:
        if face.IsTriangle:
            face_list.append([face.A, face.B, face.C])
        elif face.IsQuad:
            face_list.append([face.A, face.B, face.C])
            face_list.append([face.A, face.C, face.D])
    
    return {
        "vertices": vertex_list,
        "faces": face_list,
        "colors": vertex_colours
    }

def main(mesh):
    if not mesh:
        print("Se requiere una malla.")
        return None
    
    data = mesh_to_dict(mesh)
    
    if data is None:
        print("Error al descomponer la malla.")
        return None
    
    return json.dumps(data)

# Asignar la entrada de Grasshopper
mesh = mesh

# Ejecutar la función principal y asignar la salida
output = main(mesh)
# ---------- end py3_10 ----------
py3_11 = Python3Script(mesh=mcol_6, direccion=panel_27, printm=toggle_5)  # -> out, a; inputs mesh: Mesh, direccion: String, printm: Boolean; disabled; same code as py3_9
panel_28 = Panel(py3_10.out)  # disabled

cp_13 = ControlPoints(Curve=crv_4)  # -> Points, Weights, Knots
crv_24 = Curve(flatten(crv_22))
end_9 = EndPoints(Curve=crv_24)  # -> Start, graft(End)
pdecon_6 = Deconstruct(Point=cp_13.Points)  # -> XComponent, YComponent, ZComponent
divdist_4 = DivideDistance(Curve=crv_24, Distance=Slider(10, range=0..10))  # -> Points, Tangents, Parameters
utm_to_geo_4 = Python3Script(e=pdecon_6.XComponent, n=pdecon_6.YComponent)  # -> out, a, b; inputs e: Double, n: Double; same code as utm_to_geo
ins_7 = InsertItems(List=reverse(divdist_4.Points), Item=end_9.End, Indices=Slider(0, range=0..100), Wrap=True)  # -> reverse(List)
pline_9 = PolyLine(Vertices=ins_7, Closed=False)
pt_15 = ConstructPoint(XCoordinate=utm_to_geo_4.a, YCoordinate=utm_to_geo_4.b, ZCoordinate=0)
clean_8 = CleanTree(RemoveNulls=True, RemoveInvalid=True, RemoveEmpty=True, Tree=pline_9)  # -> flatten(Tree)
pline_10 = PolyLine(Vertices=pt_15, Closed=True)
c_script_6 = CSharpScript(x=datosxr)  # inputs x: Boolean; same code as c_script
cp_14 = ControlPoints(Curve=clean_8)  # -> Points, Weights, Knots
pdecon_7 = Deconstruct(Point=cp_14.Points)  # -> XComponent, YComponent, ZComponent
utm_to_geo_5 = Python3Script(e=pdecon_7.XComponent, n=pdecon_7.YComponent)  # -> out, a, b; inputs e: Double, n: Double; same code as utm_to_geo
pt_16 = ConstructPoint(XCoordinate=utm_to_geo_5.a, YCoordinate=utm_to_geo_5.b, ZCoordinate=pdecon_7.ZComponent)
number_slider_30 = Slider(50, range=0..100)
pline_11 = PolyLine(Vertices=pt_16, Closed=False)  # -> flatten(Polyline)
cp_15 = ControlPoints(Curve=pline_10)  # -> Points, Weights, Knots
cp_16 = ControlPoints(Curve=pline_11)  # -> simplify(Points), Weights, Knots
number_slider_31 = Slider(10, range=0..10)
cp_17 = ControlPoints(Curve=crv_24)  # -> simplify(Points), Weights, Knots
cp_18 = ControlPoints(Curve=crv_4)  # -> Points, Weights, Knots
split_6 = SplitList(List=pline_11, Index=Slider(480, range=0..1000))  # -> ListA, ListB
len_8 = Length(Curve=pline_11)
py3_12 = Python3Script(poligono=cp_18.Points, lineas=cp_17.Points, projectId=projectid)  # -> out, ARjson, b; inputs poligono: list of Point3d, lineas: tree of Point3d, projectId: String
# ---------- py3_12: Python ----------
import json

# Inicializar contadores de ID
punto_id_contador = 1
punto_id_dict = {}  # Para asignar IDs únicos a puntos basados en sus coordenadas

# Función para obtener o asignar un ID a un punto
def obtener_id_punto(punto):
    global punto_id_contador
    clave = (round(punto.X, 6), round(punto.Y, 6), round(punto.Z, 6))
    if clave not in punto_id_dict:
        punto_id_dict[clave] = punto_id_contador
        punto_id_contador += 1
    return punto_id_dict[clave]

# Procesar "poligono" usando comprensión de listas
def procesar_poligono(poligono):
    return [
        {
            "id": obtener_id_punto(punto),
            "coordenates": {
                "x": punto.X,
                "y": punto.Y,
                "z": punto.Z
            }
        }
        for punto in poligono
    ]

# Procesar una rama de "lineas" usando comprensión de listas
def procesar_rama(branch, id_linea):
    puntos_linea = [
        {
            "id": obtener_id_punto(punto),
            "coordenates": {
                "x": punto.X,
                "y": punto.Y,
                "z": punto.Z
            }
        }
        for punto in branch
    ]
    return {
        "id": id_linea,
        "points": puntos_linea
    }

# ----------------------- Ejecución Principal -----------------------

# Validar y procesar poligono
if not isinstance(poligono, list):
    raise TypeError(f"La entrada 'poligono' debe ser una lista de puntos 3D, pero se recibió {type(poligono)}.")
poligono_data = procesar_poligono(poligono)

# Validar y procesar lineas usando una técnica de acumulación
if not hasattr(lineas, 'BranchCount'):
    raise TypeError(f"La entrada 'lineas' debe ser un DataTree de puntos 3D, pero se recibió {type(lineas)}.")

lineas_data = []
for i in range(lineas.BranchCount):
    branch = list(lineas.Branch(i))  # Convertir la rama a lista estándar
    lineas_data.append(procesar_rama(branch, i + 1))
    if i % 10 == 0:  # Informar cada 10 ramas procesadas
        print(f"Procesadas {i + 1} ramas de {lineas.BranchCount}")

# Validar projectId
if projectId is None or not isinstance(projectId, str):
    raise TypeError("La entrada 'projectId' debe ser una cadena de texto válida.")

# Construir la estructura de datos final
data = {
    "Proyectos": [
        {
            projectId: {
                "poligono": poligono_data,
                "lineas": lineas_data
            }
        }
    ]
}

# Convertir la estructura de datos a un string JSON con formato
ARjson = json.dumps(data, ensure_ascii=False, indent=4)
# ---------- end py3_12 ----------

panel_29 = Panel(cp_16.Points)
panel_30 = Panel(cp_18.Points)
panel_31 = Panel(cp_15.Points)

py3_13 = Python3Script(poligono=panel_31, lineas=panel_29, projectId=projectid)  # -> out, ARjson, b; inputs poligono: list of Point3d, lineas: tree of Point3d, projectId: String; same code as py3_12

# ----
# projectId
# projectName
# projectDescription
# userId
# coordinates
# coordinatesCenter            thumbnail           lines
# mesh
# hillsides
# climatic
# soils
# matrix
# genjson
# arjoson
# lineasjson
context_print_5 = ContextPrint(Lineasjson=py3_12.ARjson)
context_print_6 = ContextPrint(ARjson=py3_13.ARjson)
