# Grasshopper definition definition.gh (Grasshopper 1.0.8)

sph = Sphere(Base=PlaneXY(0, 0, 0), Radius="6")
get_geometry = GetGeometry(
    sph,
    AnnotationTypeFilter=3966,
    AtLeast=1,
    AtMost=1,
    DeleteInput=False,
    Filter=1074081855,
    Prompt="Modelo 3D",
    TreeAccess=False)
context_bake = ContextBake(Content=get_geometry)
panel = Panel(get_geometry)
